# Grasshopper definition GeminiFlash_ImageGen_v133_demo-01.gh (Grasshopper 1.0.7)
# plug-ins: Ambrosinus Toolkit

value_list = ValueList({"Square (1:1)": 0, "Portrait (4:5)": 1, "Portrait/Land (5:4)": 2, "Story (9:16)": 3, "Panorama (2:1)": 4, "Widescreen (16:9)": 5, "Archviz Standard (3:2)": 6, "Full Frame Post (4:3)": 7, "Ultra Widescreen (21:9)": 8, "Classic Cinema (2.35:1)": 9, "Banner Post (2:3)": 10, "Cover Photo (16:10)": 11, "Archviz Landscape (1.91:1)": 12, "LinkedIn Post (1.85:1)": 13, "X Post (3:1)": 14, "Pinterest Pin (1:2)": 15, "Blog Feature Image (5:3)": 16, "Same as source": 17, "Viewport (active)": 18, "Custom A\R": 19}, selected="Same as source")
value_list_2 = ValueList({"Square (1:1)": 0, "Portrait (4:5)": 1, "Portrait/Land (5:4)": 2, "Story (9:16)": 3, "Panorama (2:1)": 4, "Widescreen (16:9)": 5, "Archviz Standard (3:2)": 6, "Full Frame Post (4:3)": 7, "Ultra Widescreen (21:9)": 8, "Classic Cinema (2.35:1)": 9, "Banner Post (2:3)": 10, "Cover Photo (16:10)": 11, "Archviz Landscape (1.91:1)": 12, "LinkedIn Post (1.85:1)": 13, "X Post (3:1)": 14, "Pinterest Pin (1:2)": 15, "Blog Feature Image (5:3)": 16, "Same as source": 17, "Viewport (active)": 18, "Custom A\R": 19}, selected="Same as source")
prompt = Panel("Generate an image with these assets by replacing two existing sofas with new yellow chair asset, I don't want sofas but only the new assets perfectly inserted in the original scene with the table")
path = FilePath("D:\Desktop\ATk_CN\GeminiGen\Ref_images\J1700060MM47_0V01.png")
path_2 = FilePath("D:\Desktop\ATk_CN\GeminiGen\Ref_images\pack-4-sedie-per-sala-pranzo-in-velluto-kana.png")
path_3 = FilePath("D:\Desktop\ATk_CN\GeminiGen\Ref_images\pack-4-sedie-per-sala-pranzo-in-velluto-kana.png")
path_4 = FilePath("D:\Desktop\ATk_CN\GeminiGen\")
merge = Merge(Data3=path_3)
la_aratioimg = ARatioImg(ImagePath=merge, FrameTypes=value_list_2, CustomAR=1)  # -> Width, Height, AspectRatio
path_5 = FilePath("D:\Desktop\ATk_CN\Test09\T2I-mlsd_img_1683123297_1.png")
la_atkimagepreview = ATkImagePreview(Path=path_5)
la_aratioimg_2 = ARatioImg(ImagePath=path_5, MaxPixel=Slider(1024, range=0..10000), FrameTypes=value_list, CustomAR=1)  # -> Width, Height, AspectRatio
la_atk_buymeacoffee = ATkSupportBuyMeACoffee()
eval = Evaluate(F="1/H*d", H=la_aratioimg.Height, d=Slider(150, range=0..2000))  # -> graft(r)
la_opendir = OpenDir(DirectoryPath=path_5)  # -> Filename, FolderPath
bang = ExplodeTree(Data=simplify(graft(merge)))
geminiimg = GeminiImageGenerator(
    Prompt=prompt,
    BaseImagePath=path_5,
    AssetImagePaths=merge,
    SaveDir=path_4,
    UseEnvKey=False,
    Timeout=10,
    Model="gemini-2.0-flash-exp-image-generation",
    Temperature=Slider(1, range=0..1),
    TopK=Slider(40, range=1..40),
    TopP=Slider(1, range=0..1),
    MaxTokens=Slider(8192, range=1..8192),
    NumImages=Slider(3, range=1..10),
    Seed=0,
    MaxWidth=la_aratioimg_2.Width,
    MaxHeight=la_aratioimg_2.Height,
    Generate=Toggle(False))  # -> Status, Images, SavePath
bang_2 = ExplodeTree(Data=simplify(eval))
panel = Panel(geminiimg.Status)
panel_2 = Panel(geminiimg.Images)
la_atkimagepreview_2 = ATkImagePreview(Path=bang, Scale=bang_2)
la_seeout = SeeOut(Output=geminiimg.SavePath, ID=Slider(33, range=0..44))  # -> SeqOut, LastOut
la_atkimagepreview_3 = ATkImagePreview(Path=la_seeout.SeqOut)
