# Grasshopper definition SD_Local_ControlNET_demo-03.gh (Grasshopper 1.0.7)
# Copyright: LA
# plug-ins: Ironbug.LBHB_Legacy, Ambrosinus Toolkit

# ----
# 1
button = Button()
path = FilePath("C:\Users\Demo\stable-diffusion-webui\")
la_launchsd_loc = LaunchSD_loc(DirectoryPath=path, StartProcess=Button(), CloseProcess=Button(), CheckProcess=button)
panel = Panel(la_launchsd_loc)

prompt = Panel("")
negative_prompt = Panel("ugly, low resolution, deformed, out of frame")
B = ValueList({"Increase": 1, "Decrease": 0}, selected="Decrease")
mode = ValueList({"T2I Basic": 0, "T2I CN-canny": 1, "T2I CN-depth": 2, "T2I CN-depth_leres": 3, "T2I CN-hed": 4, "T2I CN-mlsd": 5, "T2I CN-normal_map": 6, "T2I CN-openpose": 7, "T2I CN-openpose_hand": 8, "T2I CN-scribble": 9, "T2I CN-fake_scribble": 10, "T2I CN-segment": 11}, selected="T2I CN-canny")
path_2 = FilePath()
path_3 = FilePath()
la_imgconv = ImgConv(PathIMG=path_3, Ftype=5, Run=False)  # -> ConvIMG, Info, Width, Height
division = Division(A=la_imgconv.Width, B=la_imgconv.Height)

cluster = Cluster(opt=B, ratio=division, A=Slider(512, range=0..1000))  # -> size_a, size_b
panel_2 = Panel(cluster.size_b)
panel_3 = Panel(cluster.size_a)

number_slider = Slider(1000000, range=0..1000000)
list = ValueList({"Just Resize": 0, "Scale to Fit (Inner Fit)": 1, "Envelope (Outer Fit)": 2}, selected="Just Resize")
list_2 = ValueList({"Euler a": 0, "Euler": 1, "LMS": 2, "Heun": 3, "DPM2": 4, "DPM2 a": 5, "DPM++ 2S a": 6, "DPM++ 2M": 7, "DPM++ SDE": 8, "DPM fast": 9, "DPM adaptive": 10, "LMS Karras": 11, "DPM2 Karras": 12, "DPM2 a Karras": 13, "DPM++ 2S a Karras": 14, "DPM++ 2M Karras": 15, "DPM++ SDE Karras": 16, "DDIM": 17, "PLMS": 18, "UniPC": 19}, selected="Euler a")

# ----
# 2
number_slider_2 = Slider(0, range=0..8)
la_sdopts_loc = SDopts_loc(CheckSDmodels=Toggle(False), IDSDModels=0, StartProcess=Toggle(False))
sd_models_list = Panel(la_sdopts_loc)

# ----
# 3
la_aieng_loc = AIeNG_loc(
    ModePretrained=mode,
    TimeoutCustom=10,
    DirectoryPath=path_2,
    BaseImagePath=path_3,
    Prompt=prompt,
    NegativePrompt=negative_prompt,
    Steps=Slider(20, range=0..60),
    CfgScale=Slider(7, range=0..30),
    Weight=Slider(1, range=0..1),
    GuidanceStart=Slider(0, range=0..1),
    GuidanceEnd=Slider(1, range=0..1),
    Width=cluster.size_b,
    Height=cluster.size_a,
    Resize=list,
    NumberImgs=Slider(1, range=1..5),
    SamplerModel=list_2,
    Seed=0,
    Start=Toggle(False))  # -> Output, InfoSettings

info = Panel(la_aieng_loc.InfoSettings)
la_seeout = SeeOut(Output=la_aieng_loc.Output, ID=Slider(157, range=0..158))  # -> SeqOut, LastOut
imageviewer = Ladybug_ImageViewer(ImagePath_=path_3, _scale_=1.3, DisableClickable=False, SaveImgWithCoords=False, scale=1.3)  # -> ImagePath, Values, GIF
imageviewer_2 = Ladybug_ImageViewer(ImagePath_=la_seeout.SeqOut, _scale_=1.3, DisableClickable=False, SaveImgWithCoords=False, scale=1.3)  # -> ImagePath, Values, GIF
la_sd_imginfo = SDImginfo(ImgPath=la_seeout.SeqOut)
image_info = Panel(la_sd_imginfo)

# ==== cluster Cluster
opt = ClusterInput()
ratio = ClusterInput()
A = ClusterInput()
num = Number(ratio)
multiplication = Multiplication(A=A, B="1")
multiplication_2 = Multiplication(A=A, B=num)
division = Division(A=A, B=num)
filter = StreamFilter(Gate=opt, Stream0=multiplication_2, Stream1=division)
round = Round(Number=filter)  # -> Nearest, Floor, Ceiling
size_a = ClusterOutput(multiplication)
size_b = ClusterOutput(round.Nearest)
