# Grasshopper definition SD_Local_ControlNET_v10-11_demo-01.gh (Grasshopper 1.0.7)
# Copyright: LA
# plug-ins: Ironbug.LBHB_Legacy, Ambrosinus Toolkit

# ----
# 1
cmdargs = CMDArguments({"API": 1, "lowvram": 2, "xformers": 3, "autolaunch": 4, "theme dark": 5, "share": 6, "listen": 7, "reinstall xformers": 8, "reinstall torch": 9, "skip vers check": 10, "precision full": 11, "no half": 12, "no half vae": 13, "disable NaN check": 14, "upcast sampling": 15}, selected=["API", "lowvram", "xformers", "precision full", "no half"])
path = FilePath()
la_launchsd_loc = LaunchSD_loc(
    DirectoryPath=path,
    StartProcess=Button(),
    CloseProcess=Button(),
    CheckProcess=Button(),
    CmdArguments=cmdargs,
    GenWebui=Button(),
    Expression0="1",
    Expression1="2",
    Expression10="11",
    Expression11="12",
    Expression12="13",
    Expression13="14",
    Expression14="15",
    Expression2="3",
    Expression3="4",
    Expression4="5",
    Expression5="6",
    Expression6="7",
    Expression7="8",
    Expression8="9",
    Expression9="10",
    Name0="API",
    Name1="lowvram",
    Name10="precision full",
    Name11="no half",
    Name12="no half vae",
    Name13="disable NaN check",
    Name14="upcast sampling",
    Name2="xformers",
    Name3="autolaunch",
    Name4="theme dark",
    Name5="share",
    Name6="listen",
    Name7="reinstall xformers",
    Name8="reinstall torch",
    Name9="skip vers check")
panel = Panel(la_launchsd_loc)

path_2 = FilePath()
list = ValueList({"PNG": 0, "JPG": 1}, selected="PNG")
la_imgconv = ImgConv(PathIMG=path_2, Ftype=5, Run=False)  # -> ConvIMG, Info, Width, Height
B = ValueList({"Increase": 1, "Decrease": 0}, selected="Increase")
division = Division(A=la_imgconv.Width, B=la_imgconv.Height)
cluster = Cluster(opt=B, ratio=division, A=Slider(2000, range=0..10000))  # -> size_a, size_b
panel_2 = Panel(cluster.size_a)
panel_3 = Panel(cluster.size_b)
number_slider = Slider(1, range=0..8)
prompt = Panel("cozy interior, bauhaus furniture, trees in the background")
B_2 = ValueList({"Increase": 1, "Decrease": 0}, selected="Increase")
negative_prompt = Panel("ugly, low resolution, deformed, out of frame")
list_2 = ValueList({"Resize multipl": 0, "Custom size": 1}, selected="Custom size")

# ----
# 2
number_slider_2 = Slider(0, range=0..8)
la_sdopts_loc = SDopts_loc(CheckSDmodels=Toggle(False), IDSDModels=0, StartProcess=Toggle(False))
sd_models_list = Panel(la_sdopts_loc)

path_3 = FilePath("D:\Desktop\ATk_CN\Resize\")
mode = ValueList({"T2I Basic": 0, "T2I CN-canny": 1, "T2I CN-depth": 2, "T2I CN-depth_leres": 3, "T2I CN-hed": 4, "T2I CN-mlsd": 5, "T2I CN-normal_map": 6, "T2I CN-openpose": 7, "T2I CN-openpose_hand": 8, "T2I CN-scribble": 9, "T2I CN-fake_scribble": 10, "T2I CN-segment": 11}, selected="T2I CN-mlsd")
la_upsclai_loc = UpsclAI_loc(
    Mode=list_2,
    TimeoutCustom=10,
    CheckSDupscalers=Toggle(False),
    IDUspcales1=Slider(7, range=0..8),
    IDUspcales2=0,
    DirectoryPath=path_3,
    BaseImagePath=path_2,
    Resize=Slider(3, range=0..10),
    Width=panel_3,
    Height=panel_2,
    StartProcess=Toggle(False))  # -> UpscalersList, ImageUpsPath
path_4 = FilePath()
la_imgconv_2 = ImgConv(PathIMG=path_4, Ftype=5, Run=False)  # -> ConvIMG, Info, Width, Height
division_2 = Division(A=la_imgconv_2.Width, B=la_imgconv_2.Height)

cluster_2 = Cluster(opt=B_2, ratio=division_2, A=Slider(512, range=0..1000))  # -> size_a, size_b
panel_4 = Panel(cluster_2.size_b)
panel_5 = Panel(cluster_2.size_a)

path_5 = FilePath()
path_6 = FilePath(path_5)
la_viewcapture = ViewCapture(DirectoryPath=path_6, ImageFormat=list, ImageFilename="Filename_Test", ScaleFactor=Slider(3, range=1..10), Run=Button())  # -> ImagePath, ImagesList
panel_6 = Panel(la_viewcapture.ImagePath)
panel_7 = Panel(la_viewcapture.ImagesList)
number_slider_3 = Slider(1000000, range=0..1000000)
list_3 = ValueList({"Just Resize": 0, "Scale to Fit (Inner Fit)": 1, "Envelope (Outer Fit)": 2}, selected="Just Resize")
list_4 = ValueList({"Euler a": 0, "Euler": 1, "LMS": 2, "Heun": 3, "DPM2": 4, "DPM2 a": 5, "DPM++ 2S a": 6, "DPM++ 2M": 7, "DPM++ SDE": 8, "DPM fast": 9, "DPM adaptive": 10, "LMS Karras": 11, "DPM2 Karras": 12, "DPM2 a Karras": 13, "DPM++ 2S a Karras": 14, "DPM++ 2M Karras": 15, "DPM++ SDE Karras": 16, "DDIM": 17, "PLMS": 18, "UniPC": 19}, selected="Euler a")
ups_models_list = Panel(la_upsclai_loc.UpscalersList)
ups_full_path = Panel(la_upsclai_loc.ImageUpsPath)
la_opendir = OpenDir(DirectoryPath=path_3, Open=Button())

# ----
# 3
la_aieng_loc = AIeNG_loc(
    ModePretrained=mode,
    TimeoutCustom=10,
    DirectoryPath=path_5,
    BaseImagePath=path_4,
    Prompt=prompt,
    NegativePrompt=negative_prompt,
    Steps=Slider(20, range=0..60),
    CfgScale=Slider(5, range=0..30),
    Weight=Slider(1, range=0..1),
    GuidanceStart=Slider(0, range=0..1),
    GuidanceEnd=Slider(1, range=0..1),
    Width=cluster_2.size_b,
    Height=cluster_2.size_a,
    Resize=list_3,
    NumberImgs=Slider(1, range=1..5),
    SamplerModel=list_4,
    Seed=0,
    Start=Toggle(False))  # -> Output, InfoSettings

info = Panel(la_aieng_loc.InfoSettings)
la_seeout = SeeOut(Output=la_aieng_loc.Output, ID=Slider(15, range=0..16))  # -> SeqOut, LastOut
imageviewer = Ladybug_ImageViewer(ImagePath_=path_4, _scale_=1.3, DisableClickable=False, SaveImgWithCoords=False, scale=1.3)  # -> ImagePath, Values, GIF
imageviewer_2 = Ladybug_ImageViewer(ImagePath_=la_seeout.SeqOut, _scale_=1.3, DisableClickable=False, SaveImgWithCoords=False, scale=1.3)  # -> ImagePath, Values, GIF
la_sd_imginfo = SDImginfo(ImgPath=la_seeout.SeqOut)
image_info = Panel(la_sd_imginfo)

# ==== cluster Cluster
opt = ClusterInput()
ratio = ClusterInput()
A = ClusterInput()
num = Number(ratio)
multiplication = Multiplication(A=A, B="1")
multiplication_2 = Multiplication(A=A, B=num)
division = Division(A=A, B=num)
filter = StreamFilter(Gate=opt, Stream0=division, Stream1=multiplication_2)
round = Round(Number=filter)  # -> Nearest, Floor, Ceiling
size_a = ClusterOutput(multiplication)
size_b = ClusterOutput(round.Nearest)
