# Grasshopper definition SD_Local_ControlNET_v10-11_v126_AIvariation_base&server_demo-01.gh (Grasshopper 1.0.7)
# Copyright: LA
# plug-ins: Ambrosinus Toolkit, LadybugGrasshopper

# ----
# 4
path = FilePath()
la_imgconv = ImgConv(PathIMG=path, Ftype=5, Run=False)  # -> ConvIMG, Info, Width, Height
B = ValueList({"Increase": 1, "Decrease": 0}, selected="Increase")
division = Division(A=la_imgconv.Width, B=la_imgconv.Height)
cluster = Cluster(opt=B, ratio=division, A=Slider(1024, range=0..10000))  # -> size_a, size_b
panel = Panel(cluster.size_a)
panel_2 = Panel(cluster.size_b)
number_slider = Slider(1, range=0..8)
list = ValueList({"Resize multipl": 0, "Custom size": 1}, selected="Custom size")
path_2 = FilePath("D:\Desktop\ATk_CN\Resize\")
la_upsclai_loc = UpsclAI_loc(
    Mode=list,
    TimeoutCustom=10,
    CheckSDupscalers=Toggle(True),
    IDUspcales1=Slider(7, range=0..8),
    IDUspcales2=0,
    DirectoryPath=path_2,
    BaseImagePath=path,
    Resize=Slider(3, range=0..10),
    Width=panel_2,
    Height=panel,
    StartProcess=Toggle(False))  # -> UpscalersList, ImageUpsPath
la_opendir = OpenDir(DirectoryPath=path_2, Open=Button())
ups_models_list = Panel(la_upsclai_loc.UpscalersList)
ups_full_path = Panel(la_upsclai_loc.ImageUpsPath)

path_3 = FilePath("D:\Desktop\SDlocalCNv11\stable-diffusion-webui\")

# ----
# 1
# from server PC
# set listen only
# if you want to work on your LAN
cmdargs = CMDArguments({"API": 1, "lowvram": 2, "xformers": 3, "autolaunch": 4, "theme dark": 5, "share": 6, "listen": 7, "reinstall xformers": 8, "reinstall torch": 9, "skip vers check": 10, "precision full": 11, "no half": 12, "no half vae": 13, "disable NaN check": 14, "upcast sampling": 15}, selected=["API", "lowvram", "xformers", "precision full", "no half"])
gen = Button()
start = Button()
close = Button()
check = Button()
checkip = Button()
custom_port = Panel("7869")
path_4 = FilePath("D:\Desktop\SDlocalCNv10\stable-diffusion-webui\")
la_launchsd_loc = LaunchSD_loc(
    DirectoryPath=path_3,
    CmdArguments=cmdargs,
    IPPort=7860,
    GenWebui=gen,
    StartProcess=start,
    CloseProcess=close,
    CheckProcess=check,
    CheckIPconfig=checkip,
    Expression0="1",
    Expression1="2",
    Expression10="11",
    Expression11="12",
    Expression12="13",
    Expression13="14",
    Expression14="15",
    Expression2="3",
    Expression3="4",
    Expression4="5",
    Expression5="6",
    Expression6="7",
    Expression7="8",
    Expression8="9",
    Expression9="10",
    Name0="API",
    Name1="lowvram",
    Name10="precision full",
    Name11="no half",
    Name12="no half vae",
    Name13="disable NaN check",
    Name14="upcast sampling",
    Name2="xformers",
    Name3="autolaunch",
    Name4="theme dark",
    Name5="share",
    Name6="listen",
    Name7="reinstall xformers",
    Name8="reinstall torch",
    Name9="skip vers check")
panel_3 = Panel(la_launchsd_loc)

# ----
# 2
number_slider_2 = Slider(8, range=0..20)
la_sdopts_loc = SDopts_loc(CheckSDmodels=Toggle(False), IDSDModels=0, StartProcess=Toggle(False))
sd_models_list = Panel(la_sdopts_loc)

mskimg = FilePath()

number_slider_3 = Slider(3, range=1..10)  # disabled
panel_4 = Panel("Filename_Test")  # disabled
button = Button()  # disabled
list_2 = ValueList({"PNG": 0, "JPG": 1}, selected="PNG")  # disabled
path_5 = FilePath()  # disabled
la_viewcapture = ViewCapture(DirectoryPath=path_5, ImageFormat=list_2, ImageFilename=panel_4, ScaleFactor=number_slider_3, Run=button)  # -> ImagePath, ImagesList; disabled
panel_5 = Panel(la_viewcapture.ImagePath)  # disabled
panel_6 = Panel(la_viewcapture.ImagesList)  # disabled
B_2 = ValueList({"Increase": 1, "Decrease": 0}, selected="Increase")
cn_v1_1_mode = ValueList({"T2I Basic": 0, "T2I CN_canny": 1, "T2I CN_depth_leres": 2, "T2I CN_depth_midas": 3, "T2I CN_depth_zoe": 4, "T2I CN_lineart_anime": 5, "T2I CN_lineart_coarse": 6, "T2I CN_lineart_realistic": 7, "T2I CN_lineart_standard (from white bg & black line)": 8, "T2I CN_mlsd": 9, "T2I CN_normal_bae": 10, "T2I CN_normal_midas": 11, "T2I CN_openpose": 12, "T2I CN_openpose_face": 13, "T2I CN_openpose_faceonly": 14, "T2I CN_openpose_full": 15, "T2I CN_openpose_hand": 16, "T2I CN_scribble_hed": 17, "T2I CN_scribble_pidinet": 18, "T2I CN_scribble_xdog": 19, "T2I CN_seg_ofade20k": 20, "T2I CN_seg_ofcoco": 21, "T2I CN_seg_ufade20k": 22, "T2I CN_shuffle": 23, "T2I CN_softedge_hed": 24, "T2I CN_softedge_hedsafe": 25, "T2I CN_softedge_pidinet": 26, "T2I CN_softedge_pidisafe": 27, "T2I CN_tile_gaussian": 28}, selected="T2I CN_softedge_pidinet")
prompt = Panel("Beautiful house as a steampunk masterpiece")
negative_prompt = Panel("ugly, low resolution, deformed, out of frame")
cn_v1_0_mode = ValueList({"T2I Basic": 0, "T2I CN-canny": 1, "T2I CN-depth": 2, "T2I CN-depth_leres": 3, "T2I CN-hed": 4, "T2I CN-mlsd": 5, "T2I CN-normal_map": 6, "T2I CN-openpose": 7, "T2I CN-openpose_hand": 8, "T2I CN-scribble": 9, "T2I CN-fake_scribble": 10, "T2I CN-segment": 11}, selected="T2I CN-mlsd")
baseimg = FilePath("D:\Desktop\ATk_CN\Test_Ami\T2I-bsc_img_1702654176_1.png")
la_imgconv_2 = ImgConv(PathIMG=baseimg, Ftype=5, Run=False)  # -> ConvIMG, Info, Width, Height
division_2 = Division(A=la_imgconv_2.Width, B=la_imgconv_2.Height)
dirpath = FilePath("D:\Desktop\ATk_CN\Test_Ami\")
list_3 = ValueList({"Just Resize": 0, "Scale to Fit (Inner Fit)": 1, "Envelope (Outer Fit)": 2}, selected="Just Resize")
number_slider_4 = Slider(123456, range=0..1000000)
list_4 = ValueList({"CN v1.0": 0, "CN v1.1.X": 1}, selected="CN v1.1.X")
list_5 = ValueList({"Euler a": 0, "Euler": 1, "LMS": 2, "Heun": 3, "DPM2": 4, "DPM2 a": 5, "DPM++ 2S a": 6, "DPM++ 2M": 7, "DPM++ SDE": 8, "DPM fast": 9, "DPM adaptive": 10, "LMS Karras": 11, "DPM2 Karras": 12, "DPM2 a Karras": 13, "DPM++ 2S a Karras": 14, "DPM++ 2M Karras": 15, "DPM++ SDE Karras": 16, "DDIM": 17, "PLMS": 18, "UniPC": 19}, selected="DPM fast")
imageviewer = LBImageViewer(ImagePath_=baseimg, _scale_=1.5, DisableClickable=False, SaveImgWithCoords=False, scale=1.5)  # -> ImagePath, Values, GIF

item = ListItem(List=la_viewcapture.ImagesList, Index=0, Wrap=True)  # disabled

cluster_2 = Cluster(opt=B_2, ratio=division_2, A=Slider(512, range=0..1000))  # -> size_a, size_b
panel_7 = Panel(cluster_2.size_a)
panel_8 = Panel(cluster_2.size_b)

# ----
# 3
la_aiimgtoimgv2_loc = AIimgToimgV2_loc(
    CNVersion=list_4,
    ModePretrained=cn_v1_1_mode,
    TimeoutCustom=Slider(25, range=0..100),
    DirectoryPath=dirpath,
    BaseImagePath=baseimg,
    Prompt=prompt,
    NegativePrompt=negative_prompt,
    Steps=Slider(14, range=0..60),
    CfgScale=Slider(11, range=0..30),
    Weight=Slider(0.4, range=0..1),
    Denoise=Slider(0.45, range=0..1),
    Width=cluster_2.size_b,
    Height=cluster_2.size_a,
    Resize=list_3,
    NumberImgs=Slider(1, range=1..5),
    SamplerModel=list_5,
    Seed=0,
    Start=Toggle(False))  # -> Output, InfoSettings

la_seeout = SeeOut(Output=la_aiimgtoimgv2_loc.Output, ID=Slider(24, range=0..25))  # -> SeqOut, LastOut
imageviewer_2 = LBImageViewer(ImagePath_=la_seeout.SeqOut, _scale_=1.5, DisableClickable=False, SaveImgWithCoords=False, scale=1.5)  # -> ImagePath, Values, GIF
la_sd_imginfo = SDImginfo(ImgPath=imageviewer_2.ImagePath)
image_info = Panel(la_sd_imginfo)

# ==== cluster Cluster
opt = ClusterInput()
ratio = ClusterInput()
A = ClusterInput()
num = Number(ratio)
multiplication = Multiplication(A=A, B="1")
multiplication_2 = Multiplication(A=A, B=num)
division = Division(A=A, B=num)
filter = StreamFilter(Gate=opt, Stream0=division, Stream1=multiplication_2)
round = Round(Number=filter)  # -> Nearest, Floor, Ceiling
size_a = ClusterOutput(multiplication)
size_b = ClusterOutput(round.Nearest)
