# Grasshopper definition SD_Local_ControlNET_v10-11_v129_ALL_remote_demo-01.gh (Grasshopper 1.0.7)
# plug-ins: Ambrosinus Toolkit

# ----
# 1
# from remote PC
# If you left input params disconnected
# the default URL will be: http://127.0.0.1:7860
custom_ip = Panel("")
# Copy&Paste here below the blocks number  3 and/or 4 from the gh files named:
# 
# -AItxt2img_base&server_demo-01
# -AIimg2img_base&server_demo-01
# -AIoutpaint_base&server_demo-01
# 
# Launch WebUI on your server PC and this definition from your remote PC.
# 
# See the instructions here:
# https://bit.ly/SDandCNinsideGH-Upd3
custom_port = Panel("")
la_custipport_loc = CustIPport_loc(CustomIP="127.0.0.1", CustomPort="7860")
panel = Panel(la_custipport_loc)

la_buymeacoffee = BuyMeACoffee()

# ----
# 2
number_slider = Slider(10, range=0..20)
la_sdopts_loc = SDopts_loc(CheckSDmodels=Toggle(False), IDSDModels=0, StartProcess=Toggle(False))
sd_models_list = Panel(la_sdopts_loc)
