# Grasshopper definition SD_Local_ControlNET_v10-11_v130_AIimg2img_base&server_demo-01.gh (Grasshopper 1.0.7)
# Copyright: LA
# plug-ins: Ambrosinus Toolkit

# ----
# 4
path = FilePath()
la_imgconv = ImgConv(PathIMG=path, Ftype=5, Run=False)  # -> ConvIMG, Info, Width, Height
B = ValueList({"Increase": 1, "Decrease": 0}, selected="Increase")
division = Division(A=la_imgconv.Width, B=la_imgconv.Height)
cluster = Cluster(opt=B, ratio=division, A=Slider(1024, range=0..10000))  # -> size_a, size_b
panel = Panel(cluster.size_a)
panel_2 = Panel(cluster.size_b)
number_slider = Slider(1, range=0..8)
list = ValueList({"Resize multipl": 0, "Custom size": 1}, selected="Custom size")
path_2 = FilePath("D:\Desktop\ATk_CN\Resize\")
la_upsclai_loc = UpsclAI_loc(
    Mode=list,
    TimeoutCustom=10,
    CheckSDupscalers=Toggle(True),
    IDUspcales1=Slider(7, range=0..8),
    IDUspcales2=0,
    DirectoryPath=path_2,
    BaseImagePath=path,
    Resize=Slider(3, range=0..10),
    Width=panel_2,
    Height=panel,
    StartProcess=Toggle(False))  # -> UpscalersList, ImageUpsPath
la_opendir = OpenDir(DirectoryPath=path_2, Open=Button())
ups_models_list = Panel(la_upsclai_loc.UpscalersList)
ups_full_path = Panel(la_upsclai_loc.ImageUpsPath)

path_3 = FilePath("D:\Desktop\SDlocalCNv11\stable-diffusion-webui\")

# ----
# 1
# from server PC
# set listen only
# if you want to work on your LAN
cmdargs = CMDArguments({"API": 1, "lowvram": 2, "xformers": 3, "autolaunch": 4, "theme dark": 5, "share": 6, "listen": 7, "reinstall xformers": 8, "reinstall torch": 9, "skip vers check": 10, "precision full": 11, "no half": 12, "no half vae": 13, "disable NaN check": 14, "upcast sampling": 15}, selected=["API", "lowvram", "xformers", "precision full", "no half"])
checkip = Button()
gen = Button()
start = Button()
close = Button()
check = Button()
custom_port = Panel("7869")
path_4 = FilePath("D:\Desktop\SDlocalCNv10\stable-diffusion-webui\")
la_launchsd_loc = LaunchSD_loc(
    DirectoryPath=path_3,
    CmdArguments=cmdargs,
    IPPort=7860,
    GenWebui=gen,
    StartProcess=start,
    CloseProcess=close,
    CheckProcess=check,
    CheckIPconfig=checkip,
    Expression0="1",
    Expression1="2",
    Expression10="11",
    Expression11="12",
    Expression12="13",
    Expression13="14",
    Expression14="15",
    Expression2="3",
    Expression3="4",
    Expression4="5",
    Expression5="6",
    Expression6="7",
    Expression7="8",
    Expression8="9",
    Expression9="10",
    Name0="API",
    Name1="lowvram",
    Name10="precision full",
    Name11="no half",
    Name12="no half vae",
    Name13="disable NaN check",
    Name14="upcast sampling",
    Name2="xformers",
    Name3="autolaunch",
    Name4="theme dark",
    Name5="share",
    Name6="listen",
    Name7="reinstall xformers",
    Name8="reinstall torch",
    Name9="skip vers check")
panel_3 = Panel(la_launchsd_loc)

la_buymeacoffee = BuyMeACoffee()

# ----
# 2
number_slider_2 = Slider(8, range=0..20)
la_sdopts_loc = SDopts_loc(CheckSDmodels=Toggle(False), IDSDModels=0, StartProcess=Toggle(False))
sd_models_list = Panel(la_sdopts_loc)

number_slider_3 = Slider(25, range=0..100)
ctrlmode = ValueList({"Balanced": 0, "My prompt is more important": 1, "ControlNet is more important": 2}, selected="ControlNet is more important")
mskimg = FilePath("D:\Desktop\Extra1\Test_support\ENSAM\images\I2I_CN-lartC_img_1730728006_2.png")  # disabled
la_atkimagepreview = ATkImagePreview(Path=mskimg, Scale=0.1)  # disabled

# ----
# 3
number_slider_4 = Slider(3, range=1..10)  # disabled
panel_4 = Panel("Filename_Test")  # disabled
toggle = BooleanToggle(False)  # disabled
button = Button()  # disabled
list_2 = ValueList({"PNG": 0, "JPG": 1}, selected="PNG")  # disabled
path_5 = FilePath()  # disabled
la_viewcapture = ViewCapture(
    DirectoryPath=path_5,
    ImageFormat=list_2,
    ImageFilename=panel_4,
    ScaleFactor=number_slider_4,
    SaveNamedView=toggle,
    Run=button)  # -> ImagePath, ImagesList; disabled
panel_5 = Panel(la_viewcapture.ImagePath)  # disabled
panel_6 = Panel(la_viewcapture.ImagesList)  # disabled
item = ListItem(List=la_viewcapture.ImagesList, Index=0, Wrap=True)  # disabled
B_2 = ValueList({"Increase": 1, "Decrease": 0}, selected="Increase")
prompt = Panel("A high-definition, street-level exterior shot of a sleek, minimalist urban residence, with a lush garden and seamless indoor-outdoor flow, bathed in morning light. The design echoes the aesthetic of modern architecture pioneers like Le Corbusier, Tadao Ando, and Zaha Hadid, as showcased in cutting-edge design publications.")
negative_prompt = Panel("ugly, low resolution, deformed, out of frame")
cn_v1_1_mode = ValueList({"I2I Basic": 0, "I2I CN_canny": 1, "I2I CN_canny_invert (from white bg & black line)": 2, "I2I CN_mlsd": 3, "I2I CN_mlsd_invert (from white bg & black line)": 4, "I2I CN_lineart_standard (from white bg & black line)": 5, "I2I CN_lineart_invert (from white bg & black line)": 6, "I2I CN_lineart_realistic": 7, "I2I CN_lineart_coarse": 8, "I2I CN_lineart_anime_denoise": 9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}, selected="I2I CN_lineart_coarse")
cn_version = ValueList({"CN v1.0": 0, "CN v1.1.X": 1}, selected="CN v1.1.X")
samplers = ValueList({"DPM++ 2M": 0, "DPM++ SDE": 1, "DPM++ 2M SDE": 2, "DPM++ 2M SDE Heun": 3, "DPM++ 2S a": 4, "DPM++ 3M SDE": 5, "Euler a": 6, "Euler": 7, "LMS": 8, "Heun": 9, "DPM2": 10, "DPM2 a": 11, "DPM fast": 12, "DPM adaptive": 13, "Restart": 14, "DDIM": 15, "DDIM CFG++": 16, "PLMS": 17, "UniPC": 18, "LCM": 19}, selected="DPM++ 2S a")
number_slider_5 = Slider(1, range=1..5)
baseimg = FilePath("D:\Desktop\Extra1\Test_support\ENSAM\images\I2I_CN-lartC_img_1730728006_1.png")
la_imgconv_2 = ImgConv(PathIMG=baseimg, Ftype=5, Run=False)  # -> ConvIMG, Info, Width, Height
division_2 = Division(A=la_imgconv_2.Width, B=la_imgconv_2.Height)
number_slider_6 = Slider(123456, range=0..1000000)
resize = ValueList({"Just Resize": 0, "Crop and Resize": 1, "Resize and Fill": 2}, selected="Just Resize")
la_atkimagepreview_2 = ATkImagePreview(Path=baseimg, Scale=0.1)
dirpath = FilePath()

cluster_2 = Cluster(opt=B_2, ratio=division_2, A=Slider(512, range=0..1000))  # -> size_a, size_b
panel_7 = Panel(cluster_2.size_a)
panel_8 = Panel(cluster_2.size_b)

la_aiimgtoimgv3_loc = AIimgToimgV3_loc(
    CNVersion=cn_version,
    ModePretrained=cn_v1_1_mode,
    TimeoutCustom=10,
    DirectoryPath=dirpath,
    BaseImagePath=la_atkimagepreview_2,
    Prompt=prompt,
    NegativePrompt=negative_prompt,
    Steps=Slider(12, range=0..60),
    CfgScale=Slider(7, range=0..30),
    Weight=Slider(0.66, range=0..1),
    Denoise=Slider(0.75, range=0..1),
    Width=cluster_2.size_b,
    Height=cluster_2.size_a,
    ControlMode=ctrlmode,
    Resize=resize,
    NumberImgs=1,
    SamplerModel=samplers,
    Seed=0,
    Start=Toggle(False))  # -> Output, InfoSettings
la_seeout = SeeOut(Output=la_aiimgtoimgv3_loc.Output, ID=Slider(0, range=0..63))  # -> SeqOut, LastOut
la_atkimagepreview_3 = ATkImagePreview(Path=la_seeout.SeqOut, Scale=Slider(0.5, range=0..1))
la_sd_imginfo = SDImginfo(ImgPath=la_atkimagepreview_3)
image_info = Panel(la_sd_imginfo)

# ==== cluster Cluster
opt = ClusterInput()
ratio = ClusterInput()
A = ClusterInput()
num = Number(ratio)
multiplication = Multiplication(A=A, B="1")
multiplication_2 = Multiplication(A=A, B=num)
division = Division(A=A, B=num)
filter = StreamFilter(Gate=opt, Stream0=division, Stream1=multiplication_2)
round = Round(Number=filter)  # -> Nearest, Floor, Ceiling
size_a = ClusterOutput(multiplication)
size_b = ClusterOutput(round.Nearest)
