# Grasshopper definition SD_Local_ControlNET_v10-11_v132_AIimg2img_base&server_demo-01.gh (Grasshopper 1.0.7)
# plug-ins: Ambrosinus Toolkit

# ----
# 4
number_slider = Slider(1024, range=0..10000)
path = FilePath("S:\Progetti\_GH_PRJ\Ambrosinus_Toolkit\$_ATk_presentation\Exercise\Images files\WS_Upsc\I2I_CN-lartC_img_1730879739_1.png")
la_aratioimg = ARatioImg(ImagePath=path, MaxPixel=number_slider, CustomAR=1)  # -> Width, Height, AspectRatio
number_slider_2 = Slider(1, range=0..20)
mode = ValueList({"Resize multiplier": 0, "Custom size": 1}, selected="Resize multiplier")
path_2 = FilePath("D:\Desktop\ATk_CN\Resize\")
la_upsclai_loc = UpsclAI_loc(
    Mode=mode,
    TimeoutCustom=Slider(30, range=10..100),
    CheckSDupscalers=Toggle(False),
    IDUspcales1=Slider(13, range=0..30),
    IDUspcales2=0,
    DirectoryPath=path_2,
    BaseImagePath=path,
    Resize=Slider(3, range=0..10),
    Width=la_aratioimg.Width,
    Height=la_aratioimg.Height,
    StartProcess=Toggle(False))  # -> UpscalersList, ImageUpsPath, Status
la_opendir = OpenDir(DirectoryPath=la_upsclai_loc.ImageUpsPath)  # -> Filename, FolderPath
ups_models_list = Panel(la_upsclai_loc.UpscalersList)
ups_full_path = Panel(la_upsclai_loc.ImageUpsPath)
ups_status = Panel(la_upsclai_loc.Status)

path_3 = FilePath("D:\Desktop\SDlocalCNv11\stable-diffusion-webui\")

# ----
# set listen only
# if you want to work on your LAN
# 1
# from server PC
cmdargs = CMDArguments({"API": 1, "lowvram": 2, "xformers": 3, "autolaunch": 4, "theme dark": 5, "share": 6, "listen": 7, "reinstall xformers": 8, "reinstall torch": 9, "skip vers check": 10, "precision full": 11, "no half": 12, "no half vae": 13, "disable NaN check": 14, "upcast sampling": 15}, selected=["API", "lowvram", "xformers", "precision full", "no half"])
checkip = Button()
gen = Button()
start = Button()
close = Button()
check = Button()
custom_port = Panel("7869")
path_4 = FilePath("D:\Desktop\SDlocalCNv10\stable-diffusion-webui\")
la_launchsd_loc = LaunchSD_loc(
    DirectoryPath=path_3,
    CmdArguments=cmdargs,
    IPPort=7860,
    GenWebui=gen,
    StartProcess=start,
    CloseProcess=close,
    CheckProcess=check,
    CheckIPconfig=checkip,
    Expression0="1",
    Expression1="2",
    Expression10="11",
    Expression11="12",
    Expression12="13",
    Expression13="14",
    Expression14="15",
    Expression2="3",
    Expression3="4",
    Expression4="5",
    Expression5="6",
    Expression6="7",
    Expression7="8",
    Expression8="9",
    Expression9="10",
    Name0="API",
    Name1="lowvram",
    Name10="precision full",
    Name11="no half",
    Name12="no half vae",
    Name13="disable NaN check",
    Name14="upcast sampling",
    Name2="xformers",
    Name3="autolaunch",
    Name4="theme dark",
    Name5="share",
    Name6="listen",
    Name7="reinstall xformers",
    Name8="reinstall torch",
    Name9="skip vers check")
panel = Panel(la_launchsd_loc)

la_buymeacoffee = BuyMeACoffee()

# ----
# 2
number_slider_3 = Slider(10, range=0..20)
la_sdopts_loc = SDopts_loc(CheckSDmodels=Toggle(False), IDSDModels=0, StartProcess=Toggle(False))
sd_models_list = Panel(la_sdopts_loc)

# ----
# 3.b
number_slider_4 = Slider(255, range=1..255)

# ----
# 3
number_slider_5 = Slider(768, range=0..1024)
prompt = Panel("vertical garden with bushes and trees")
negative_prompt = Panel("(normal quality), (low quality), (worst quality), paintings, sketches")
la_aratioimg_2 = ARatioImg(CustomAR=1)  # -> Width, Height, AspectRatio
cn_v1_1_mode = ValueList({"I2I Basic": 0, "I2I CN_canny": 1, "I2I CN_canny_invert (from white bg & black line)": 2, "I2I CN_mlsd": 3, "I2I CN_mlsd_invert (from white bg & black line)": 4, "I2I CN_lineart_standard (from white bg & black line)": 5, "I2I CN_lineart_invert (from white bg & black line)": 6, "I2I CN_lineart_realistic": 7, "I2I CN_lineart_coarse": 8, "I2I CN_lineart_anime_denoise": 9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}, selected="I2I CN_softedge_pidinet": 11)
baseimg = FilePath("D:\Desktop\Extra1\WS_I2I\T2I_example.png")
mskimg = FilePath("D:\Desktop\Extra1\WS_I2I\myMask_test_bm.jpg")
ctrlmode = ValueList({"Balanced": 0, "My prompt is more important": 1, "ControlNet is more important": 2}, selected="Balanced")
cn_version = ValueList({"CN v1.0": 0, "CN v1.1.X": 1}, selected="CN v1.1.X")
la_atkimagepreview = ATkImagePreview(Path=baseimg, Scale=0.03)
la_atkimagepreview_2 = ATkImagePreview(Path=mskimg, Scale=0.03)
samplers = ValueList({"DPM++ 2M": 0, "DPM++ SDE": 1, "DPM++ 2M SDE": 2, "DPM++ 2M SDE Heun": 3, "DPM++ 2S a": 4, "DPM++ 3M SDE": 5, "Euler a": 6, "Euler": 7, "LMS": 8, "Heun": 9, "DPM2": 10, "DPM2 a": 11, "DPM fast": 12, "DPM adaptive": 13, "Restart": 14, "DDIM": 15, "DDIM CFG++": 16, "PLMS": 17, "UniPC": 18, "LCM": 19}, selected="DPM++ 2M")
resize = ValueList({"Just Resize": 0, "Crop and Resize": 1, "Resize and Fill": 2}, selected="Just Resize")
dirpath = FilePath("D:\Desktop\Extra1\WS_I2I\")
seed = Panel("294771637")

la_setpreprocessor_loc = SetPreProcessor(
    ImagePath=dirpath,
    ProcessorType=cn_v1_1_mode,
    ThresholdA=number_slider_4,
    ThresholdB=Slider(255, range=1..255),
    Run=Toggle(False))  # -> MaskPath, Info
panel_2 = Panel(la_setpreprocessor_loc.Info)
la_atkimagepreview_3 = ATkImagePreview(Path=la_setpreprocessor_loc.MaskPath, Scale=Slider(0.35, range=0..1))

# ----
# 3.a
la_aiimgtoimgv3_loc = AIimgToimgV3_loc(
    CNVersion=cn_version,
    ModePretrained=cn_v1_1_mode,
    TimeoutCustom=Slider(25, range=0..100),
    DirectoryPath=dirpath,
    BaseImagePath=la_atkimagepreview,
    Prompt=prompt,
    NegativePrompt=negative_prompt,
    Steps=Slider(20, range=0..60),
    CfgScale=Slider(5.5, range=0..30),
    Weight=Slider(0.8, range=0..1),
    Denoise=Slider(0.9, range=0..1),
    Width=la_aratioimg_2.Width,
    Height=la_aratioimg_2.Height,
    ControlMode=ctrlmode,
    Resize=resize,
    NumberImgs=Slider(1, range=1..5),
    SamplerModel=samplers,
    Seed="0",
    Start=Toggle(False))  # -> Output, InfoSettings

la_seeout = SeeOut(Output=la_aiimgtoimgv3_loc.Output, ID=Slider(17, range=0..18))  # -> SeqOut, LastOut
la_atkimagepreview_4 = ATkImagePreview(Path=la_seeout.SeqOut, Scale=Slider(0.5, range=0..2))
la_sd_imginfo = SDImginfo(ImgPath=la_atkimagepreview_4)
image_info = Panel(la_sd_imginfo)
