# Grasshopper definition SD_Local_ControlNET_v11_v131_AIoutpaint_base&server_demo-01.gh (Grasshopper 1.0.7)
# Copyright: LA
# plug-ins: Ambrosinus Toolkit

# ----
# 4
path = FilePath()
la_imgconv = ImgConv(PathIMG=path, Ftype=5, Run=False)  # -> ConvIMG, Info, Width, Height
B = ValueList({"Increase": 1, "Decrease": 0}, selected="Increase")
division = Division(A=la_imgconv.Width, B=la_imgconv.Height)
cluster = Cluster(opt=B, ratio=division, A=Slider(1024, range=0..10000))  # -> size_a, size_b
panel = Panel(cluster.size_a)
panel_2 = Panel(cluster.size_b)
number_slider = Slider(1, range=0..8)
list = ValueList({"Resize multipl": 0, "Custom size": 1}, selected="Custom size")
path_2 = FilePath("D:\Desktop\ATk_CN\Resize\")
la_upsclai_loc = UpsclAI_loc(
    Mode=list,
    TimeoutCustom=10,
    CheckSDupscalers=Toggle(True),
    IDUspcales1=Slider(7, range=0..8),
    IDUspcales2=0,
    DirectoryPath=path_2,
    BaseImagePath=path,
    Resize=Slider(3, range=0..10),
    Width=panel_2,
    Height=panel,
    StartProcess=Toggle(False))  # -> UpscalersList, ImageUpsPath
la_opendir = OpenDir(DirectoryPath=path_2, Open=Button())
ups_full_path = Panel(la_upsclai_loc.ImageUpsPath)
ups_models_list = Panel(la_upsclai_loc.UpscalersList)

path_3 = FilePath("D:\Desktop\SDlocalCNv11\stable-diffusion-webui\")

# ----
# 1
# from server PC
# set listen only
# if you want to work on your LAN
cmdargs = CMDArguments({"API": 1, "lowvram": 2, "xformers": 3, "autolaunch": 4, "theme dark": 5, "share": 6, "listen": 7, "reinstall xformers": 8, "reinstall torch": 9, "skip vers check": 10, "precision full": 11, "no half": 12, "no half vae": 13, "disable NaN check": 14, "upcast sampling": 15}, selected=["API", "lowvram", "xformers", "precision full", "no half"])
checkip = Button()
gen = Button()
start = Button()
close = Button()
check = Button()
custom_port = Panel("7869")
path_4 = FilePath("D:\Desktop\SDlocalCNv10\stable-diffusion-webui\")
la_launchsd_loc = LaunchSD_loc(
    DirectoryPath=path_3,
    CmdArguments=cmdargs,
    IPPort=7860,
    GenWebui=gen,
    StartProcess=start,
    CloseProcess=close,
    CheckProcess=check,
    CheckIPconfig=checkip,
    Expression0="1",
    Expression1="2",
    Expression10="11",
    Expression11="12",
    Expression12="13",
    Expression13="14",
    Expression14="15",
    Expression2="3",
    Expression3="4",
    Expression4="5",
    Expression5="6",
    Expression6="7",
    Expression7="8",
    Expression8="9",
    Expression9="10",
    Name0="API",
    Name1="lowvram",
    Name10="precision full",
    Name11="no half",
    Name12="no half vae",
    Name13="disable NaN check",
    Name14="upcast sampling",
    Name2="xformers",
    Name3="autolaunch",
    Name4="theme dark",
    Name5="share",
    Name6="listen",
    Name7="reinstall xformers",
    Name8="reinstall torch",
    Name9="skip vers check")
panel_3 = Panel(la_launchsd_loc)

la_buymeacoffee = BuyMeACoffee()

# ----
# 2
number_slider_2 = Slider(8, range=0..20)
la_sdopts_loc = SDopts_loc(CheckSDmodels=Toggle(False), IDSDModels=0, StartProcess=Toggle(False))
sd_models_list = Panel(la_sdopts_loc)

# ----
# 3
number_slider_3 = Slider(3, range=1..10)  # disabled
panel_4 = Panel("Filename_Test")  # disabled
toggle = BooleanToggle(False)  # disabled
button = Button()  # disabled
list_2 = ValueList({"PNG": 0, "JPG": 1}, selected="PNG")  # disabled
path_5 = FilePath()  # disabled
la_viewcapture = ViewCapture(
    DirectoryPath=path_5,
    ImageFormat=list_2,
    ImageFilename=panel_4,
    ScaleFactor=number_slider_3,
    SaveNamedView=toggle,
    Run=button)  # -> ImagePath, ImagesList; disabled
panel_5 = Panel(la_viewcapture.ImagePath)  # disabled
panel_6 = Panel(la_viewcapture.ImagesList)  # disabled
item = ListItem(List=la_viewcapture.ImagesList, Index=0, Wrap=True)  # disabled
B_2 = ValueList({"Increase": 1, "Decrease": 0}, selected="Decrease")
prompt = Panel("playground in the green city")
negative_prompt = Panel("ugly, low resolution, deformed, out of frame")
cn_v1_1_mode = ValueList({"inpaint_only": 0, "inpaint_only+lama": 1, "inpaint_global_harmonious": 2}, selected="inpaint_only")
tiumeout = Slider(30, range=0..100)
path_6 = FilePath("D:\Desktop\Extra1\Test_support\ENSAM\images\I2I_CN-lartC_img_1730728006_1.png")
ctrlmode = ValueList({"Balanced": 0, "My prompt is more important": 1, "ControlNet is more important": 2}, selected="Balanced")
samplers = ValueList({"DPM++ 2M": 0, "DPM++ SDE": 1, "DPM++ 2M SDE": 2, "DPM++ 2M SDE Heun": 3, "DPM++ 2S a": 4, "DPM++ 3M SDE": 5, "Euler a": 6, "Euler": 7, "LMS": 8, "Heun": 9, "DPM2": 10, "DPM2 a": 11, "DPM fast": 12, "DPM adaptive": 13, "Restart": 14, "DDIM": 15, "DDIM CFG++": 16, "PLMS": 17, "UniPC": 18, "LCM": 19}, selected="DPM++ 2M SDE")
typegen = ValueList({"T2I": 0, "I2I": 1}, selected="T2I")
la_atkimagepreview = ATkImagePreview(Path="D:\Desktop\Extra1\Test_support\ENSAM\images\I2I_CN-lartC_img_1730728006_1.png", Scale=0.1)
la_imgconv_2 = ImgConv(PathIMG=la_atkimagepreview, Ftype=5, Run=False)  # -> ConvIMG, Info, Width, Height
division_2 = Division(A=la_imgconv_2.Width, B=la_imgconv_2.Height)
number_slider_4 = Slider(123456, range=0..1000000)
path_7 = FilePath("D:\Desktop\Extra1\Test_support\ENSAM\images\")
panel_7 = Panel("1024")
panel_8 = Panel("1400")

cluster_2 = Cluster(opt=B_2, ratio=division_2, A=Slider(512, range=0..1000))  # -> size_a, size_b
panel_9 = Panel(cluster_2.size_a)
panel_10 = Panel(cluster_2.size_b)

la_aioutpaintv2_loc = AIoutpaintV2_loc(
    TypeGen=typegen,
    ModePretrained=cn_v1_1_mode,
    TimeoutCustom=tiumeout,
    DirectoryPath=path_7,
    BaseImagePath=la_atkimagepreview,
    Prompt=prompt,
    NegativePrompt=negative_prompt,
    Steps=Slider(12, range=0..60),
    CfgScale=Slider(10, range=0..30),
    Weight=Slider(1, range=0..1),
    GuidanceStart=Slider(0, range=0..1),
    GuidanceEnd=Slider(1, range=0..1),
    Denoise=Slider(0.45, range=0..1),
    Width=cluster_2.size_a,
    Height=cluster_2.size_a,
    ControlMode=ctrlmode,
    NumberImgs=Slider(1, range=1..5),
    SamplerModel=samplers,
    Seed=0,
    Start=Toggle(False))  # -> Output, InfoSettings
la_seeout = SeeOut(Output=la_aioutpaintv2_loc.Output, ID=Slider(96, range=0..97))  # -> SeqOut, LastOut
la_atkimagepreview_2 = ATkImagePreview(Path=la_seeout.SeqOut, Scale=Slider(0.5, range=0..1))
la_sd_imginfo = SDImginfo(ImgPath=la_atkimagepreview_2)
image_info = Panel(la_sd_imginfo)

# ==== cluster Cluster
opt = ClusterInput()
ratio = ClusterInput()
A = ClusterInput()
num = Number(ratio)
multiplication = Multiplication(A=A, B="1")
multiplication_2 = Multiplication(A=A, B=num)
division = Division(A=A, B=num)
filter = StreamFilter(Gate=opt, Stream0=division, Stream1=multiplication_2)
round = Round(Number=filter)  # -> Nearest, Floor, Ceiling
size_a = ClusterOutput(multiplication)
size_b = ClusterOutput(round.Nearest)
