# Grasshopper definition SD_Local_ControlNET_v11_v132_AIoutpaint_base&server_demo-01.gh (Grasshopper 1.0.7)
# plug-ins: Ambrosinus Toolkit

# ----
# 4
number_slider = Slider(1024, range=0..10000)
path = FilePath("S:\Progetti\_GH_PRJ\Ambrosinus_Toolkit\$_ATk_presentation\Exercise\Images files\WS_Upsc\I2I_CN-lartC_img_1730879739_1.png")
la_aratioimg = ARatioImg(ImagePath=path, MaxPixel=number_slider, CustomAR=1)  # -> Width, Height, AspectRatio
number_slider_2 = Slider(1, range=0..20)
mode = ValueList({"Resize multiplier": 0, "Custom size": 1}, selected="Resize multiplier")
path_2 = FilePath("D:\Desktop\ATk_CN\Resize\")
la_upsclai_loc = UpsclAI_loc(
    Mode=mode,
    TimeoutCustom=Slider(30, range=10..100),
    CheckSDupscalers=Toggle(False),
    IDUspcales1=Slider(13, range=0..30),
    IDUspcales2=0,
    DirectoryPath=path_2,
    BaseImagePath=path,
    Resize=Slider(3, range=0..10),
    Width=la_aratioimg.Width,
    Height=la_aratioimg.Height,
    StartProcess=Toggle(False))  # -> UpscalersList, ImageUpsPath, Status
la_opendir = OpenDir(DirectoryPath=la_upsclai_loc.ImageUpsPath)  # -> Filename, FolderPath
ups_models_list = Panel(la_upsclai_loc.UpscalersList)
ups_full_path = Panel(la_upsclai_loc.ImageUpsPath)
ups_status = Panel(la_upsclai_loc.Status)

# ----
# 3
value_list = ValueList({"Square (1:1)": 0, "Portrait (4:5)": 1, "Portrait/Land (5:4)": 2, "Story (9:16)": 3, "Panorama (2:1)": 4, "Widescreen (16:9)": 5, "Archviz Standard (3:2)": 6, "Full Frame Post (4:3)": 7, "Ultra Widescreen (21:9)": 8, "Classic Cinema (2.35:1)": 9, "Banner Post (2:3)": 10, "Cover Photo (16:10)": 11, "Archviz Landscape (1.91:1)": 12, "LinkedIn Post (1.85:1)": 13, "X Post (3:1)": 14, "Pinterest Pin (1:2)": 15, "YouTube Image (16:9)": 16, "Medium Article Image (3:1)": 17, "Blog Feature Image (5:3)": 18, "Same as source": 19, "Custom A\R": 20}, selected="Square (1:1)")
la_aratioimg_2 = ARatioImg(MaxPixel=Slider(1024, range=0..1024), PostTypes=value_list, CustomAR=1)  # -> Width, Height, AspectRatio
negative_prompt = Panel("ugly, low resolution, deformed, out of frame")
prompt = Panel("modern northern Europe building, meeting center")
cn_v1_1_mode = ValueList({"inpaint_only": 0, "inpaint_only+lama": 1, "inpaint_global_harmonious": 2}, selected="inpaint_only+lama")
tiumeout = Slider(30, range=0..100)
path_3 = FilePath("S:\Progetti\_GH_PRJ\Ambrosinus_Toolkit\$_ATk_presentation\Exercise\Images files\Outpainting reference\00004-3519200471.png")
ctrlmode = ValueList({"Balanced": 0, "My prompt is more important": 1, "ControlNet is more important": 2}, selected="Balanced")
samplers = ValueList({"DPM++ 2M": 0, "DPM++ SDE": 1, "DPM++ 2M SDE": 2, "DPM++ 2M SDE Heun": 3, "DPM++ 2S a": 4, "DPM++ 3M SDE": 5, "Euler a": 6, "Euler": 7, "LMS": 8, "Heun": 9, "DPM2": 10, "DPM2 a": 11, "DPM fast": 12, "DPM adaptive": 13, "Restart": 14, "DDIM": 15, "DDIM CFG++": 16, "PLMS": 17, "UniPC": 18, "LCM": 19}, selected="DPM++ 2M")
typegen = ValueList({"T2I": 0, "I2I": 1}, selected="T2I")
path_4 = FilePath("D:\Desktop\ATk_CN\CN_Outpainting_Test3\")
la_atkimagepreview = ATkImagePreview(Path=path_3, Scale=0.1)
panel = Panel("936")
panel_2 = Panel("1024")
seed = Panel("289686668")
la_aioutpaintv3_loc = AIoutpaintV3_loc(
    TypeGen=typegen,
    ModePretrained=cn_v1_1_mode,
    TimeoutCustom=tiumeout,
    DirectoryPath=path_4,
    BaseImagePath=la_atkimagepreview,
    Prompt=prompt,
    NegativePrompt=negative_prompt,
    Steps=Slider(20, range=0..60),
    CfgScale=Slider(7, range=0..30),
    Weight=Slider(1, range=0..1),
    GuidanceStart=Slider(0, range=0..1),
    GuidanceEnd=Slider(1, range=0..1),
    Denoise=Slider(0.7, range=0..1),
    Width=la_aratioimg_2.Width,
    Height=la_aratioimg_2.Height,
    ControlMode=ctrlmode,
    NumberImgs=Slider(1, range=1..5),
    SamplerModel=samplers,
    Seed="0",
    Start=Toggle(False))  # -> Output, InfoSettings
la_seeout = SeeOut(Output=la_aioutpaintv3_loc.Output, ID=Slider(55, range=0..56))  # -> SeqOut, LastOut
la_atkimagepreview_2 = ATkImagePreview(Path=la_seeout.SeqOut, Scale=Slider(0.5, range=0..1))
la_sd_imginfo = SDImginfo(ImgPath=la_atkimagepreview_2)
image_info = Panel(la_sd_imginfo)

path_5 = FilePath("D:\Desktop\SDlocalCNv11\stable-diffusion-webui\")

# ----
# 1
# from server PC
# set listen only
# if you want to work on your LAN
cmdargs = CMDArguments({"API": 1, "lowvram": 2, "xformers": 3, "autolaunch": 4, "theme dark": 5, "share": 6, "listen": 7, "reinstall xformers": 8, "reinstall torch": 9, "skip vers check": 10, "precision full": 11, "no half": 12, "no half vae": 13, "disable NaN check": 14, "upcast sampling": 15}, selected=["API", "lowvram", "xformers", "precision full", "no half"])
checkip = Button()
gen = Button()
start = Button()
close = Button()
check = Button()
custom_port = Panel("7869")
path_6 = FilePath("D:\Desktop\SDlocalCNv10\stable-diffusion-webui\")
la_launchsd_loc = LaunchSD_loc(
    DirectoryPath=path_5,
    CmdArguments=cmdargs,
    IPPort=7860,
    GenWebui=gen,
    StartProcess=start,
    CloseProcess=close,
    CheckProcess=check,
    CheckIPconfig=checkip,
    Expression0="1",
    Expression1="2",
    Expression10="11",
    Expression11="12",
    Expression12="13",
    Expression13="14",
    Expression14="15",
    Expression2="3",
    Expression3="4",
    Expression4="5",
    Expression5="6",
    Expression6="7",
    Expression7="8",
    Expression8="9",
    Expression9="10",
    Name0="API",
    Name1="lowvram",
    Name10="precision full",
    Name11="no half",
    Name12="no half vae",
    Name13="disable NaN check",
    Name14="upcast sampling",
    Name2="xformers",
    Name3="autolaunch",
    Name4="theme dark",
    Name5="share",
    Name6="listen",
    Name7="reinstall xformers",
    Name8="reinstall torch",
    Name9="skip vers check")
panel_3 = Panel(la_launchsd_loc)

la_buymeacoffee = BuyMeACoffee()

# ----
# 2
number_slider_3 = Slider(8, range=0..20)
la_sdopts_loc = SDopts_loc(CheckSDmodels=Toggle(False), IDSDModels=0, StartProcess=Toggle(False))
sd_models_list = Panel(la_sdopts_loc)
