# Grasshopper definition SD_Local_ControlNET_v11_v133_AItxt2img_base&server_demo-01.gh (Grasshopper 1.0.7)
# plug-ins: Ambrosinus Toolkit

# ----
# 4
path = FilePath("D:\Desktop\ATk_CN\I2I_oupainting\outPNTt2i-inptOL_img_1735926462_1.png")
la_aratioimg = ARatioImg(ImagePath=path, CustomAR=1)  # -> Width, Height, AspectRatio
path_2 = FilePath("D:\Desktop\ATk_CN\Resize\")
la_upsclai_loc = UpsclAI_loc(
    Mode=0,
    TimeoutCustom=10,
    CheckSDupscalers=Toggle(False),
    IDUspcales1=Slider(1, range=0..20),
    IDUspcales2=Slider(17, range=0..20),
    DirectoryPath=path_2,
    BaseImagePath=path,
    Resize=Slider(3, range=0..10),
    Width=la_aratioimg.Width,
    Height=la_aratioimg.Height,
    StartProcess=Toggle(False))  # -> UpscalersList, ImageUpsPath, Status
la_opendir = OpenDir(DirectoryPath=la_upsclai_loc.ImageUpsPath)  # -> Filename, FolderPath
ups_models_list = Panel(la_upsclai_loc.UpscalersList)
ups_full_path = Panel(la_upsclai_loc.ImageUpsPath)
ups_status = Panel(la_upsclai_loc.Status)

# ----
# 3.c
styles = ValueList({"No Style": 2, "||| PHOTOGRAPHY": 3, "Photography | Aerial": 4, "Photography | Architecture": 5, "Photography | Black and White": 6, "Photography | Cinematic": 7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}, selected="Photography | Night": 22)
styles_2 = ValueList({"No Style": 2, "||| PHOTOGRAPHY": 3, "Photography | Aerial": 4, "Photography | Architecture": 5, "Photography | Black and White": 6, "Photography | Cinematic": 7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}, selected="Photography | Time-lapse": 33)
la_sdstyle_loc = SDStyle_loc(Style=[styles, styles_2], ShowStyleName=False)
panel = Panel(la_sdstyle_loc)

path_3 = FilePath()
la_buymeacoffee = BuyMeACoffee()

# ----
# 2
number_slider = Slider(0, range=0..20)
number_slider_2 = Slider(2, range=0..20)
la_sdchkp_loc = SDchkp_loc(CheckSDmodels=Toggle(False), IDSDModels=0, SetMods=Toggle(False))
la_sdvae_loc = SDVae_loc(CheckSDVae=Toggle(False), IDSDVae=0, SetVAE=Toggle(False))
sd_checkpoint_models_list = Panel(la_sdchkp_loc)
sd_vae_models_list = Panel(la_sdvae_loc)

# ----
# 1
# set listen only
# if you want to work on your LAN
# from server PC
# left full path clear
# to use default settings
cmdargs = CMDArguments({"API": 1, "lowvram": 2, "xformers": 3, "autolaunch": 4, "theme dark": 5, "share": 6, "listen": 7, "reinstall xformers": 8, "reinstall torch": 9, "skip vers check": 10, "precision full": 11, "no half": 12, "no half vae": 13, "disable NaN check": 14, "upcast sampling": 15, "custom checkpoints": 16, "custom lora": 17, "custom vae": 18, "custom embeddings": 19, "custom hypernetworks": 20}, selected=["API", "lowvram", "xformers", "precision full", "no half"])
path_4 = FilePath()
la_modelpaths = ModelPaths(CheckpointsDir=path_4, VAEDir=path_3, ClearPaths=False)  # -> Status, CommandModelArgs
checkip = Button()
close = Button()
check = Button()
gen = Button()
start = Button()
custom_port = Panel("7869")
path_5 = FilePath("D:\Desktop\SDlocalCNv11\stable-diffusion-webui\")
path_6 = FilePath("D:\Desktop\SDlocalCNv10\stable-diffusion-webui\")
panel_2 = Panel(la_modelpaths.Status)

la_launchsdv2_loc = LaunchSD_loc(
    DirectoryPath=path_5,
    CmdArguments=cmdargs,
    IPPort=7860,
    ModelPathArgs=la_modelpaths.CommandModelArgs,
    GenWebui=gen,
    StartProcess=start,
    CloseProcess=close,
    CheckProcess=check,
    CheckIPconfig=checkip,
    Expression0="1",
    Expression1="2",
    Expression10="11",
    Expression11="12",
    Expression12="13",
    Expression13="14",
    Expression14="15",
    Expression15="16",
    Expression16="17",
    Expression17="18",
    Expression18="19",
    Expression19="20",
    Expression2="3",
    Expression3="4",
    Expression4="5",
    Expression5="6",
    Expression6="7",
    Expression7="8",
    Expression8="9",
    Expression9="10",
    Name0="API",
    Name1="lowvram",
    Name10="precision full",
    Name11="no half",
    Name12="no half vae",
    Name13="disable NaN check",
    Name14="upcast sampling",
    Name15="custom checkpoints",
    Name16="custom lora",
    Name17="custom vae",
    Name18="custom embeddings",
    Name19="custom hypernetworks",
    Name2="xformers",
    Name3="autolaunch",
    Name4="theme dark",
    Name5="share",
    Name6="listen",
    Name7="reinstall xformers",
    Name8="reinstall torch",
    Name9="skip vers check")

panel_3 = Panel(la_launchsdv2_loc)

# ----
# 3.b
number_slider_3 = Slider(255, range=1..255)

# ----
# 3
value_list = ValueList({"Square (1:1)": 0, "Portrait (4:5)": 1, "Portrait/Land (5:4)": 2, "Story (9:16)": 3, "Panorama (2:1)": 4, "Widescreen (16:9)": 5, "Archviz Standard (3:2)": 6, "Full Frame Post (4:3)": 7, "Ultra Widescreen (21:9)": 8, "Classic Cinema (2.35:1)": 9, "Banner Post (2:3)": 10, "Cover Photo (16:10)": 11, "Archviz Landscape (1.91:1)": 12, "LinkedIn Post (1.85:1)": 13, "X Post (3:1)": 14, "Pinterest Pin (1:2)": 15, "YouTube Image (16:9)": 16, "Medium Article Image (3:1)": 17, "Blog Feature Image (5:3)": 18, "Same as source": 19, "Custom A\R": 20}, selected="Portrait (4:5)")
number_slider_4 = Slider(800, range=0..1024)
cn_v1_1_mode = ValueList({"T2I Basic": 0, "T2I CN_canny": 1, "T2I CN_canny_invert (from white bg & black line)": 2, "T2I CN_mlsd": 3, "T2I CN_mlsd_invert (from white bg & black line)": 4, "T2I CN_lineart_standard (from white bg & black line)": 5, "T2I CN_lineart_invert (from white bg & black line)": 6, "T2I CN_lineart_realistic": 7, "T2I CN_lineart_coarse": 8, "T2I CN_lineart_anime_denoise": 9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}, selected="T2I CN_lineart_anime": 10)
prompt = Panel("modern skyscraper, light trails")
negative_prompt = Panel("")
path_7 = FilePath("D:\Desktop\ATk_CN\I2I_ws\Senza titolo.png")
ctrlmode = ValueList({"Balanced": 0, "My prompt is more important": 1, "ControlNet is more important": 2}, selected="Balanced")
samplers = ValueList({"DPM++ 2M": 0, "DPM++ SDE": 1, "DPM++ 2M SDE": 2, "DPM++ 2M SDE Heun": 3, "DPM++ 2S a": 4, "DPM++ 3M SDE": 5, "Euler a": 6, "Euler": 7, "LMS": 8, "Heun": 9, "DPM2": 10, "DPM2 a": 11, "DPM fast": 12, "DPM adaptive": 13, "Restart": 14, "DDIM": 15, "DDIM CFG++": 16, "PLMS": 17, "UniPC": 18, "LCM": 19}, selected="DPM++ 2M")
cn_version = ValueList({"CN v1.0": 0, "CN v1.1.X": 1}, selected="CN v1.1.X")
resize = ValueList({"Just Resize": 0, "Crop and Resize": 1, "Resize and Fill": 2}, selected="Just Resize")
la_atkimagepreview = ATkImagePreview(Path=path_7, Scale=Slider(0.25, range=0..1))
la_aratioimg_2 = ARatioImg(ImagePath=la_atkimagepreview, MaxPixel=number_slider_4, CustomAR=1)  # -> Width, Height, AspectRatio
path_8 = FilePath("D:\Desktop\Extra1\Test_support\ENSAM\images\")
seed = Panel("3101090149")

la_setpreprocessor_loc = SetPreProcessor(
    ImagePath=la_atkimagepreview,
    ProcessorType=cn_v1_1_mode,
    Resolution=number_slider_4,
    ThresholdA=Slider(255, range=1..255),
    ThresholdB=number_slider_3,
    Run=Toggle(False))  # -> MaskPath, Info
panel_4 = Panel(la_setpreprocessor_loc.Info)
la_atkimagepreview_2 = ATkImagePreview(Path=la_setpreprocessor_loc.MaskPath, Scale=Slider(0.38, range=0..1))

# ----
# 3.a
la_aitxttoimgv3_loc = AItxtToimgV3_loc(
    CNVersion=cn_version,
    ModePretrained=cn_v1_1_mode,
    TimeoutCustom=Slider(25, range=0..100),
    DirectoryPath=path_8,
    BaseImagePath=la_atkimagepreview,
    Prompt=prompt,
    NegativePrompt=negative_prompt,
    Steps=Slider(40, range=0..60),
    CfgScale=Slider(6, range=0..30),
    Weight=Slider(0.9, range=0..1),
    GuidanceStart=Slider(0, range=0..1),
    GuidanceEnd=Slider(1, range=0..1),
    Width=la_aratioimg_2.Width,
    Height=la_aratioimg_2.Height,
    ControlMode=ctrlmode,
    Resize=resize,
    NumberImgs=Slider(1, range=1..5),
    SamplerModel=samplers,
    Seed="0",
    Start=Toggle(False))  # -> Output, InfoSettings

la_seeout = SeeOut(Output=la_aitxttoimgv3_loc.Output, ID=Slider(253, range=0..253))  # -> SeqOut, LastOut
la_opendir_2 = OpenDir(DirectoryPath=la_aitxttoimgv3_loc.Output)  # -> Filename, FolderPath
la_atkimagepreview_3 = ATkImagePreview(Path=la_seeout.SeqOut, Scale=Slider(0.5, range=0..2))
la_sd_imginfo = SDImginfo(ImgPath=la_atkimagepreview_3)
image_info = Panel(la_sd_imginfo)
