# Grasshopper definition ATk_MinBBox_MinBSph_demo_v1.gh (Grasshopper 1.0.7)
# Copyright: LA
# plug-ins: Human, Ambrosinus Toolkit

# ----
# 2D/3D Shapes
geom_single_test = Geometry([<brep referenced from the Rhino model> x4, <curve referenced from the Rhino model> x5, <brep referenced from the Rhino model>, <curve referenced from the Rhino model> x13])
curves_planar = Geometry([<curve referenced from the Rhino model> x6])
curves = Geometry([<curve referenced from the Rhino model> x10])
_3d = Geometry([<brep referenced from the Rhino model> x5])
sphere = Geometry(<brep referenced from the Rhino model>)

popgeo = PopulateGeometry(Geometry=geom_single_test, Count=100, Seed=1)  # disabled
number_slider = Slider(4.04, range=0..100)  # disabled
avr = Average(Input=popgeo)  # disabled
la_atk_buymeacoffee = ATkSupportBuyMeACoffee()

# ---- group: Input mesh
mesh = Mesh(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)
mesh_2 = Mesh(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)

# ----
pipe = Pipe(Curve=curves, Radius=Slider(0.1, range=0..0.6), Caps=0)  # -> simplify(Pipe)
points = PointList(Points=flatten(avr), Size=number_slider)  # disabled
merge = Merge(Data1=mesh, Data2=mesh_2)
geo = Geometry(pipe)
merge_2 = Merge(Data1=_3d, Data2=geo)
preview = CustomPreview(Geometry=merge_2, Material=ColourSwatch(SwatchColor=RGB(0, 0, 0)))

# ---- group: LA_ATk
la_minbbox = MinBBox(Geometry=geom_single_test)  # -> Info, MinBBox, Volume, Area, Center, PrincipalDirection, PlaneY, PlaneZ, PlaneBY, PlaneBZ
la_minbsph = MinBSphere(Geometry=geom_single_test, UseExact=Toggle(False), Algorithm=Slider(0, range=0..3))  # -> Info, MinSphere, Volume, Area, Center, Radius, KeyPoints

# ----
sec = BrepPlane(Brep=la_minbsph.MinSphere, Plane=la_minbbox.PlaneY)  # -> Curves, Points
pt = Point(la_minbsph.KeyPoints)
preview_2 = CustomPreview(Geometry=sec.Curves, Material=ColourSwatch(SwatchColor=RGB(0, 71, 214)))
preview_3 = CustomPreview(Geometry=la_minbsph.MinSphere, Material=ColourSwatch(SwatchColor=RGBA(45, 179, 181, 35)))
preview_4 = CustomPreview(Geometry=la_minbbox.MinBBox, Material=ColourSwatch(SwatchColor=RGBA(214, 73, 242, 35)))
area = Area(Geometry=sec.Curves)  # -> Area, Centroid
volume = Panel(la_minbbox.Volume)
volume_2 = Panel(la_minbsph.Volume)
points_2 = PointList(Points=flatten(la_minbsph.Center), Size=Slider(4.04, range=0..100))
panel = Panel(area.Area)
area_2 = Panel(la_minbbox.Area)
area_3 = Panel(la_minbsph.Area)
info = Panel(la_minbbox.Info)
points_3 = Panel(pt)
info_2 = Panel(la_minbsph.Info)

# ----
# Disassembly Abacus Test
input_geo = Geometry(flatten(merge_2))  # disabled
la_minbbox_2 = MinBBox(Geometry=input_geo)  # -> Info, MinBBox, Volume, Area, Center, PrincipalDirection, PlaneY, PlaneZ, PlaneBY, PlaneBZ; disabled
number_slider_2 = Slider(20, range=0..200)  # disabled
number_slider_3 = Slider(20, range=0..500)  # disabled
toggle = BooleanToggle(True)  # disabled
pt_2 = Point(<point referenced from the Rhino model>)  # disabled
swatch = ColourSwatch(SwatchColor=RGBA(214, 73, 242, 35))  # disabled
swatch_2 = ColourSwatch(SwatchColor=RGB(0, 0, 0))  # disabled
panel_2 = Panel("2")  # disabled

# ---- group: simple GH grid Cluster
cluster = Cluster(relay=input_geo, G=pt_2, A=la_minbbox_2.Center, B_2=number_slider_2, B=number_slider_3, Z=toggle)  # disabled

# ----
orient = Orient(Geometry=la_minbbox_2.Info, Source=la_minbbox_2.PlaneZ, Target=cluster)  # -> Geometry, Transform; disabled
orient_2 = Orient(Geometry=input_geo, Source=la_minbbox_2.PlaneZ, Target=cluster)  # -> Geometry, Transform; disabled
edges = BrepEdges(Brep=orient.Geometry)  # -> Naked, Interior, NonManifold; disabled
previewlw = CustomPreviewLineweights(Geometry=[edges.Naked, edges.Interior, edges.NonManifold], Shader=swatch, Thickness=panel_2, Absolute=False)  # disabled
preview_5 = CustomPreview(Geometry=orient_2.Geometry, Material=swatch_2)  # disabled

# ==== cluster Cluster
relay = ClusterInput()
lng = ListLength(List=relay)
series = Series(Start=0, Step=1, Count=lng)  # -> simplify(Series)
tstat = TreeStatistics(Tree=series)  # -> Paths, Length, Count
series_2 = Series(Start=0, Step=1, Count=tstat.Count)  # -> simplify(Series)
B = ClusterInput()
B_2 = ClusterInput()
multiplication = Multiplication(A=series, B=B)
multiplication_2 = Multiplication(A=series_2, B=B_2)
G = ClusterInput()
X = UnitX(Factor=multiplication_2)
Y = UnitY(Factor=multiplication)
move = Move(Geometry=G, Motion=X)  # -> Geometry, Transform
move_2 = Move(Geometry=graft(move.Geometry), Motion=Y)  # -> Geometry, Transform
A = ClusterInput()
vec2pt = Vector2Pt(PointA=A, PointB=move_2.Geometry, Unitize=False)  # -> Vector, Length
xy = XYPlane(Origin=move_2.Geometry)
Z = ClusterInput()
move_3 = Move(Motion=vec2pt.Vector)  # -> Geometry, Transform; disabled
flippln = FlipPlane(Plane=xy, FlipX=False, FlipY=False, FlipZ=Z)  # -> Flipped, R
deplane = DeconstructPlane(Plane=flippln.Flipped)  # -> Origin, XAxis, YAxis, ZAxis
amp = Amplitude(Vector=deplane.ZAxis, Amplitude=Slider(2, range=0..100))
vdis = VectorDisplay(Anchor=flippln.Flipped, Vector=amp)
F = ClusterOutput(flippln.Flipped)
