# Grasshopper definition SetCanvas_v1_demo-01.gh (Grasshopper 1.0.7)
# plug-ins: Ambrosinus Toolkit

la_setcanvas = SetCanvas(
    CustomCanvas=Toggle(False),
    CanvasBack=ColourSwatch(SwatchColor=RGB(255, 255, 255)),
    CanvasGrid=ColourSwatch(SwatchColor=RGBA(51, 187, 255, 70)),
    CustomPnl=Toggle(False),
    PnlBack=ColourSwatch(SwatchColor=RGB(255, 255, 255)),
    CustomWire=Toggle(False),
    WireStart=ColourSwatch(SwatchColor=RGBA(0, 0, 0, 50)),
    WireEnd=ColourSwatch(SwatchColor=RGB(150, 0, 150)),
    CustomComp=Toggle(False),
    CompBody=ColourSwatch(SwatchColor=RGB(255, 255, 255)),
    CompEdge=ColourSwatch(SwatchColor=RGB(255, 0, 68)),
    CompText=ColourSwatch(SwatchColor=RGB(45, 182, 250)),
    CompCore=ColourSwatch(SwatchColor=RGB(255, 255, 255)))
multiplication = Multiplication(A=Slider(6, range=0..10), B=Slider(4, range=0..10))
panel = Panel(multiplication)
