# Grasshopper definition LA_ATk_Mask-Edit_demo-01.gh (Grasshopper 1.0.7)
# plug-ins: Ambrosinus Toolkit

value_list = ValueList({"Square (1:1)": 0, "Portrait (4:5)": 1, "Portrait/Land (5:4)": 2, "Story (9:16)": 3, "Panorama (2:1)": 4, "Widescreen (16:9)": 5, "Archviz Standard (3:2)": 6, "Full Frame Post (4:3)": 7, "Ultra Widescreen (21:9)": 8, "Classic Cinema (2.35:1)": 9, "Banner Post (2:3)": 10, "Cover Photo (16:10)": 11, "Archviz Landscape (1.91:1)": 12, "LinkedIn Post (1.85:1)": 13, "X Post (3:1)": 14, "Pinterest Pin (1:2)": 15, "Blog Feature Image (5:3)": 16, "Same as source": 17, "Viewport (active)": 18, "Custom A\R": 19}, selected="Same as source")

# ----
# 1
button = Button()

# ---- group: INPUT
# CutOut Mask Edit
path = FilePath("D:\Desktop\SDlocal_CNv11\ATk_WS_Exercise\Exercise\Images files\WS_I2I\T2I_example.png")
geo_curves = Geometry(<curve referenced from the Rhino model>)
geo_holes = Geometry(<curve referenced from the Rhino model>)

# ----
# GreyGauss Mask Edit
path_2 = FilePath("D:\Desktop\")
la_atkimagepreview = ATkImagePreview(Path=path, Scale=Slider(0.5, range=0..1))
la_aratioimg = ARatioImg(ImagePath=path, FrameTypes=value_list, CustomAR=1)  # -> Width, Height, AspectRatio
la_filenamer = FileNamer(DirPath=path_2, MaskName="GrayMsk", Run=button)  # -> MaskPath, Filename

# ----
# 2
button_2 = Button()

# ---- group: INPUT
path_3 = FilePath(path)

# ----
dom = ConstructDomain(DomainStart="0", DomainEnd=la_aratioimg.Width)
dom_2 = ConstructDomain(DomainStart="0", DomainEnd=la_aratioimg.Height)
la_graygaussmask = GrayGaussMask(
    BaseImage=path_3,
    MaskPath=la_filenamer.MaskPath,
    MaskName=la_filenamer.Filename,
    PaintThreshold=Slider(80, range=0..255),
    Strength=Slider(0.6, range=0..1),
    KernelSize=Slider(21, range=1..101),
    Sigma=Slider(9, range=1..50),
    RunProcess=button_2)  # -> Messages, Output
button_3 = Button()
rectangle = Rectangle(Plane=PlaneXY(0, 0, 0), XSize=dom, YSize=dom_2, Radius=0)  # -> Rectangle, Length
la_opendir = OpenDir(DirectoryPath=la_graygaussmask.Output)  # -> Filename, FolderPath
img = ImportImage(File=la_atkimagepreview, Rectangle=rectangle.Rectangle)
item = ListItem(List=la_graygaussmask.Output, Index=0, Wrap=False)  # -> Item, Item1
path_4 = FilePath("D:\Desktop\")
panel = Panel(la_graygaussmask.Messages)
la_atkimagepreview_2 = ATkImagePreview(Path=item.Item1, Scale=0.4)
swatch = ColourSwatch(SwatchColor=RGBA(0, 0, 0, 0))
swatch_2 = ColourSwatch(SwatchColor=RGB(0, 207, 230))
swatch_3 = ColourSwatch(SwatchColor=RGB(230, 0, 91))
list = ValueList({"Image": 0, "Back/Mask": 1}, selected="Back/Mask")
la_imagemask = ImageMask(
    BaseIMG=path,
    Frame=rectangle.Rectangle,
    Curves=geo_curves,
    Holes=geo_curves,
    Width=la_aratioimg.Width,
    Height=la_aratioimg.Height,
    MaskPath=path_4,
    MaskName="myMask",
    MaskColor=RGB(255, 255, 255),
    BackColor=RGB(0, 0, 0),
    Mode=list,
    Run=Button())
la_atkimagepreview_3 = ATkImagePreview(Path=item.Item, Scale=0.4)
la_atkimagepreview_4 = ATkImagePreview(Path=la_imagemask, Scale=Slider(0.5, range=0..1))
