# Grasshopper definition SD_Local_ControlNET_v11_v133_AIimg2img_base&server_demo-01.gh (Grasshopper 1.0.7)
# plug-ins: Ambrosinus Toolkit

# ----
# 4
path = FilePath()
la_aratioimg = ARatioImg(ImagePath=path, CustomAR=1)  # -> Width, Height, AspectRatio
path_2 = FilePath("D:\Desktop\ATk_CN\Resize\")
la_upsclai_loc = UpsclAI_loc(
    Mode=0,
    TimeoutCustom=10,
    CheckSDupscalers=Toggle(False),
    IDUspcales1=Slider(1, range=0..20),
    IDUspcales2=Slider(17, range=0..20),
    DirectoryPath=path_2,
    BaseImagePath=path,
    Resize=Slider(3, range=0..10),
    Width=la_aratioimg.Width,
    Height=la_aratioimg.Height,
    StartProcess=Toggle(False))  # -> UpscalersList, ImageUpsPath, Status
la_opendir = OpenDir(DirectoryPath=la_upsclai_loc.ImageUpsPath)  # -> Filename, FolderPath
ups_models_list = Panel(la_upsclai_loc.UpscalersList)
ups_full_path = Panel(la_upsclai_loc.ImageUpsPath)
ups_status = Panel(la_upsclai_loc.Status)

path_3 = FilePath()
la_buymeacoffee = BuyMeACoffee()

# ----
# 2
number_slider = Slider(7, range=0..20)
number_slider_2 = Slider(2, range=0..20)
la_sdchkp_loc = SDchkp_loc(CheckSDmodels=Toggle(False), IDSDModels=0, SetMods=Toggle(False))
la_sdvae_loc = SDVae_loc(CheckSDVae=Toggle(False), IDSDVae=0, SetVAE=Toggle(False))
sd_checkpoint_models_list = Panel(la_sdchkp_loc)
sd_vae_models_list = Panel(la_sdvae_loc)

# ----
# 1
# set listen only
# if you want to work on your LAN
# from server PC
# left full path clear
# to use default settings
cmdargs = CMDArguments({"API": 1, "lowvram": 2, "xformers": 3, "autolaunch": 4, "theme dark": 5, "share": 6, "listen": 7, "reinstall xformers": 8, "reinstall torch": 9, "skip vers check": 10, "precision full": 11, "no half": 12, "no half vae": 13, "disable NaN check": 14, "upcast sampling": 15, "custom checkpoints": 16, "custom lora": 17, "custom vae": 18, "custom embeddings": 19, "custom hypernetworks": 20}, selected=["API", "lowvram", "xformers", "precision full", "no half"])
path_4 = FilePath()
la_modelpaths = ModelPaths(CheckpointsDir=path_4, VAEDir=path_3, ClearPaths=False)  # -> Status, CommandModelArgs
checkip = Button()
close = Button()
check = Button()
gen = Button()
start = Button()
custom_port = Panel("7869")
path_5 = FilePath("D:\Desktop\SDlocalCNv11\stable-diffusion-webui\")
path_6 = FilePath("D:\Desktop\SDlocalCNv10\stable-diffusion-webui\")
panel = Panel(la_modelpaths.Status)

la_launchsdv2_loc = LaunchSD_loc(
    DirectoryPath=path_5,
    CmdArguments=cmdargs,
    IPPort=7860,
    ModelPathArgs=la_modelpaths.CommandModelArgs,
    GenWebui=gen,
    StartProcess=start,
    CloseProcess=close,
    CheckProcess=check,
    CheckIPconfig=checkip,
    Expression0="1",
    Expression1="2",
    Expression10="11",
    Expression11="12",
    Expression12="13",
    Expression13="14",
    Expression14="15",
    Expression15="16",
    Expression16="17",
    Expression17="18",
    Expression18="19",
    Expression19="20",
    Expression2="3",
    Expression3="4",
    Expression4="5",
    Expression5="6",
    Expression6="7",
    Expression7="8",
    Expression8="9",
    Expression9="10",
    Name0="API",
    Name1="lowvram",
    Name10="precision full",
    Name11="no half",
    Name12="no half vae",
    Name13="disable NaN check",
    Name14="upcast sampling",
    Name15="custom checkpoints",
    Name16="custom lora",
    Name17="custom vae",
    Name18="custom embeddings",
    Name19="custom hypernetworks",
    Name2="xformers",
    Name3="autolaunch",
    Name4="theme dark",
    Name5="share",
    Name6="listen",
    Name7="reinstall xformers",
    Name8="reinstall torch",
    Name9="skip vers check")

panel_2 = Panel(la_launchsdv2_loc)

# ----
# 3.b
number_slider_3 = Slider(255, range=1..255)

# ----
# 3
value_list = ValueList({"Square (1:1)": 0, "Portrait (4:5)": 1, "Portrait/Land (5:4)": 2, "Story (9:16)": 3, "Panorama (2:1)": 4, "Widescreen (16:9)": 5, "Archviz Standard (3:2)": 6, "Full Frame Post (4:3)": 7, "Ultra Widescreen (21:9)": 8, "Classic Cinema (2.35:1)": 9, "Banner Post (2:3)": 10, "Cover Photo (16:10)": 11, "Archviz Landscape (1.91:1)": 12, "LinkedIn Post (1.85:1)": 13, "X Post (3:1)": 14, "Pinterest Pin (1:2)": 15, "Blog Feature Image (5:3)": 16, "Same as source": 17, "Viewport (active)": 18, "Custom A\R": 19}, selected="Same as source")
number_slider_4 = Slider(600, range=0..1024)
prompt = Panel("modern skyscraper,northern country background, sunset professional aerial photo,mir-v3, <lora:MIR-v3:0.7>")
negative_prompt = Panel("(normal quality), (low quality), (worst quality), paintings, sketches,fog,signature,soft, blurry,drawing,sketch, poor quality, uply text,type, word, logo, pixelated, low resolution.,saturated,high contrast, oversharpened,dirt,")
list = ValueList({"PNG": 0, "JPG": 1}, selected="PNG")
cn_v1_1_mode = ValueList({"I2I Basic": 0, "I2I CN_canny": 1, "I2I CN_canny_invert (from white bg & black line)": 2, "I2I CN_mlsd": 3, "I2I CN_mlsd_invert (from white bg & black line)": 4, "I2I CN_lineart_standard (from white bg & black line)": 5, "I2I CN_lineart_invert (from white bg & black line)": 6, "I2I CN_lineart_realistic": 7, "I2I CN_lineart_coarse": 8, "I2I CN_lineart_anime_denoise": 9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}, selected="I2I CN_softedge_pidinet": 11)
baseimg = FilePath("D:\Desktop\SDlocal_CNv11\ATk_WS_Exercise\Exercise\Images files\WS_I2I\T2I_example.png")
mskimg = FilePath("D:\Desktop\SDlocal_CNv11\ATk_WS_Exercise\Exercise\Images files\WS_I2I\myMask_test_bm.jpg")
ctrlmode = ValueList({"Balanced": 0, "My prompt is more important": 1, "ControlNet is more important": 2}, selected="Balanced")
la_atkimagepreview = ATkImagePreview(Path=mskimg, Scale=Slider(0.12, range=0..1))
la_atkimagepreview_2 = ATkImagePreview(Path=baseimg, Scale=Slider(0.11, range=0..1))
la_aratioimg_2 = ARatioImg(ImagePath=la_atkimagepreview_2, MaxPixel=number_slider_4, FrameTypes=value_list, CustomAR=1)  # -> Width, Height, AspectRatio
cn_version = ValueList({"CN v1.0": 0, "CN v1.1.X": 1}, selected="CN v1.1.X")
samplers = ValueList({"DPM++ 2M": 0, "DPM++ SDE": 1, "DPM++ 2M SDE": 2, "DPM++ 2M SDE Heun": 3, "DPM++ 2S a": 4, "DPM++ 3M SDE": 5, "Euler a": 6, "Euler": 7, "LMS": 8, "Heun": 9, "DPM2": 10, "DPM2 a": 11, "DPM fast": 12, "DPM adaptive": 13, "Restart": 14, "DDIM": 15, "DDIM CFG++": 16, "PLMS": 17, "UniPC": 18, "LCM": 19}, selected="DPM++ 2M")
resize = ValueList({"Just Resize": 0, "Crop and Resize": 1, "Resize and Fill": 2}, selected="Just Resize")
dirpath = FilePath("D:\Desktop\Extra1\PoliMI_WS\I2I\")
path_7 = FilePath(dirpath)
la_viewcapture = ViewCaptureV2(
    DirectoryPath=path_7,
    ImageFormat=list,
    ImageFilename="Tower_Test3",
    MaxPixel=number_slider_4,
    AspectRatio=la_aratioimg_2.AspectRatio,
    ScaleFactor=Slider(1, range=1..10),
    SaveNamedView=Toggle(False),
    Run=Button())  # -> ImagePath, ImagesList
seed = Panel("294771637")

la_setpreprocessor_loc = SetPreProcessor(
    ImagePath=la_atkimagepreview_2,
    ProcessorType=cn_v1_1_mode,
    Resolution=512,
    ThresholdA=number_slider_3,
    ThresholdB=Slider(255, range=1..255),
    Run=Toggle(False))  # -> MaskPath, Info
la_atkimagepreview_3 = ATkImagePreview(Path=la_setpreprocessor_loc.MaskPath, Scale=Slider(0.35, range=0..1))
panel_3 = Panel(la_setpreprocessor_loc.Info)

# ----
# 3.a
la_aiimgtoimgv3_loc = AIimgToimgV3_loc(
    CNVersion=cn_version,
    ModePretrained=cn_v1_1_mode,
    TimeoutCustom=Slider(25, range=0..100),
    DirectoryPath=dirpath,
    BaseImagePath=la_atkimagepreview_2,
    Prompt=prompt,
    NegativePrompt=negative_prompt,
    Steps=Slider(16, range=0..60),
    CfgScale=Slider(5.5, range=0..30),
    Weight=Slider(0.8, range=0..1),
    Denoise=Slider(0.9, range=0..1),
    Width=la_aratioimg_2.Width,
    Height=la_aratioimg_2.Height,
    ControlMode=ctrlmode,
    Resize=resize,
    NumberImgs=Slider(1, range=1..5),
    SamplerModel=samplers,
    Seed="0",
    Start=Toggle(False))  # -> Output, InfoSettings

la_seeout = SeeOut(Output=la_aiimgtoimgv3_loc.Output, ID=Slider(15, range=0..16))  # -> SeqOut, LastOut
la_atkimagepreview_4 = ATkImagePreview(Path=la_seeout.SeqOut, Scale=Slider(0.5, range=0..2))
la_sd_imginfo = SDImginfo(ImgPath=la_atkimagepreview_4)
image_info = Panel(la_sd_imginfo)
