# Grasshopper definition SD_Local_ControlNET_v11_v133_MultiCN_demo-01.gh (Grasshopper 1.0.7)
# plug-ins: Ambrosinus Toolkit

# ---- group: Style weights
repeat = RepeatData(Data=Slider(2.5, range=0..10), Length="16")

# ---- group: Composition weights
panel = Panel("""4
5""")
replace = ReplaceItems(List=repeat, Item=Slider(0, range=0..1), Indices=panel, Wrap=False)

# ----
# 3b
# (only for custom weights)
panel_2 = Panel(",")
join = TextJoin(Text=replace, Join=panel_2)
data = Data(flatten(join))
panel_3 = Panel(data)

path = FilePath("D:\Desktop\ComfyUI\ComfyUI_windows_portable\ComfyUI\models\vae\")

cn_v1_1_mode = ValueList({"T2I CN_canny": 0, "T2I CN_canny_invert (from white bg & black line)": 1, "T2I CN_mlsd": 2, "T2I CN_mlsd_invert (from white bg & black line)": 3, "T2I CN_lineart_standard (from white bg & black line)": 4, "T2I CN_lineart_invert (from white bg & black line)": 5, "T2I CN_lineart_realistic": 6, "T2I CN_lineart_coarse": 7, "T2I CN_lineart_anime_denoise": 8, "T2I CN_lineart_anime": 9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}, selected="T2I CN_ip-adapter-auto": 29)
ctrlmode = ValueList({"Balanced": 0, "My prompt is more important": 1, "ControlNet is more important": 2}, selected="ControlNet is more important")
path_2 = FilePath("D:\Desktop\ATk_CN\CNunit\images\RWAV-08-2024-waggoner_1.png")
resize = ValueList({"Just Resize": 0, "Crop and Resize": 1, "Resize and Fill": 2}, selected="Just Resize")
la_atkimagepreview = ATkImagePreview(Path=path_2, Scale=Slider(0.12, range=0..1))

cn_v1_1_mode_2 = ValueList({"T2I CN_canny": 0, "T2I CN_canny_invert (from white bg & black line)": 1, "T2I CN_mlsd": 2, "T2I CN_mlsd_invert (from white bg & black line)": 3, "T2I CN_lineart_standard (from white bg & black line)": 4, "T2I CN_lineart_invert (from white bg & black line)": 5, "T2I CN_lineart_realistic": 6, "T2I CN_lineart_coarse": 7, "T2I CN_lineart_anime_denoise": 8, "T2I CN_lineart_anime": 9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}, selected="T2I CN_canny")
ctrlmode_2 = ValueList({"Balanced": 0, "My prompt is more important": 1, "ControlNet is more important": 2}, selected="My prompt is more important")
path_3 = FilePath("D:\Desktop\ATk_CN\CNunit\images\T2I_mCN-img_1731615318_1.png")
resize_2 = ValueList({"Just Resize": 0, "Crop and Resize": 1, "Resize and Fill": 2}, selected="Just Resize")
la_atkimagepreview_2 = ATkImagePreview(Path=path_3, Scale=Slider(0.15, range=0..1))

cn_v1_1_mode_3 = ValueList({"T2I CN_canny": 0, "T2I CN_canny_invert (from white bg & black line)": 1, "T2I CN_mlsd": 2, "T2I CN_mlsd_invert (from white bg & black line)": 3, "T2I CN_lineart_standard (from white bg & black line)": 4, "T2I CN_lineart_invert (from white bg & black line)": 5, "T2I CN_lineart_realistic": 6, "T2I CN_lineart_coarse": 7, "T2I CN_lineart_anime_denoise": 8, "T2I CN_lineart_anime": 9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}, selected="T2I CN_depth_midas": 19)
ctrlmode_3 = ValueList({"Balanced": 0, "My prompt is more important": 1, "ControlNet is more important": 2}, selected="My prompt is more important")
path_4 = FilePath("D:\Desktop\ATk_CN\CNunit\images\T2I_mCN-img_1731615318_1.png")
resize_3 = ValueList({"Just Resize": 0, "Crop and Resize": 1, "Resize and Fill": 2}, selected="Just Resize")
la_atkimagepreview_3 = ATkImagePreview(Path=path_4, Scale=Slider(0.15, range=0..1))

# ----
# 3a
weighttype = ValueList({"normal": 0, "ease in": 1, "ease out": 2, "ease in-out": 3, "reverse in-out": 4, "weak input": 5, "weak output": 6, "weak middle": 7, "strong middle": 8, "style transfer": 9, "composition": 10, "strong style transfer": 11, "style and composition": 12, "strong style and composition": 13, "custom weight": 14}, selected="custom weight")
panel_4 = Panel(data)
la_ipadptset_loc = IPadptSet(WeightTypes=weighttype, CustomWeight=panel_4)  # -> IPAdaptorSettings, AdvWeighting
la_cnunit_loc = CNunit(
    ModePretrained=cn_v1_1_mode,
    BaseImagePath=la_atkimagepreview,
    Weight=Slider(1, range=0..1),
    GuidanceStart=Slider(0.1, range=0..1),
    GuidanceEnd=Slider(0.9, range=0..1),
    ControlMode=ctrlmode,
    Resize=resize,
    AdvancedSettings=la_ipadptset_loc.IPAdaptorSettings)
la_cnunit_loc_2 = CNunit(
    ModePretrained=cn_v1_1_mode_2,
    BaseImagePath=la_atkimagepreview_2,
    Weight=Slider(1, range=0..1),
    GuidanceStart=Slider(0.1, range=0..1),
    GuidanceEnd=Slider(0.9, range=0..1),
    ControlMode=ctrlmode_2,
    Resize=resize_2)
la_cnunit_loc_3 = CNunit(
    ModePretrained=cn_v1_1_mode_3,
    BaseImagePath=la_atkimagepreview_3,
    Weight=Slider(1, range=0..1),
    GuidanceStart=Slider(0.1, range=0..1),
    GuidanceEnd=Slider(0.9, range=0..1),
    ControlMode=ctrlmode_3,
    Resize=resize_3)

# ----
# 4
# Current model
# Style to transfer
# Style transfered
value_list = ValueList({"Square (1:1)": 0, "Portrait (4:5)": 1, "Portrait/Land (5:4)": 2, "Story (9:16)": 3, "Panorama (2:1)": 4, "Widescreen (16:9)": 5, "Archviz Standard (3:2)": 6, "Full Frame Post (4:3)": 7, "Ultra Widescreen (21:9)": 8, "Classic Cinema (2.35:1)": 9, "Banner Post (2:3)": 10, "Cover Photo (16:10)": 11, "Archviz Landscape (1.91:1)": 12, "LinkedIn Post (1.85:1)": 13, "X Post (3:1)": 14, "Pinterest Pin (1:2)": 15, "Blog Feature Image (5:3)": 16, "Same as source": 17, "Viewport (active)": 18, "Custom A\R": 19}, selected="Same as source")
prompt = Panel("Beautiful interior design with huge window  with curtains")
negative_prompt = Panel("ugly, low resolution, deformed, out of frame")
la_aratioimg = ARatioImg(ImagePath=la_atkimagepreview_3, MaxPixel="600", FrameTypes=value_list, CustomAR=1)  # -> Width, Height, AspectRatio
samplers = ValueList({"DPM++ 2M": 0, "DPM++ SDE": 1, "DPM++ 2M SDE": 2, "DPM++ 2M SDE Heun": 3, "DPM++ 2S a": 4, "DPM++ 3M SDE": 5, "Euler a": 6, "Euler": 7, "LMS": 8, "Heun": 9, "DPM2": 10, "DPM2 a": 11, "DPM fast": 12, "DPM adaptive": 13, "Restart": 14, "DDIM": 15, "DDIM CFG++": 16, "PLMS": 17, "UniPC": 18, "LCM": 19}, selected="DPM++ 2M")
panel_5 = Panel("3917346879")
path_5 = FilePath("D:\Desktop\ATk_CN\CNunit\images\")
la_ai_mcnt2i_loc = AImultiCNT2IV2(
    Start=Toggle(False),
    TimeoutCustom=Slider(35, range=0..100),
    DirectoryPath=path_5,
    Prompt=prompt,
    NegativePrompt=negative_prompt,
    Steps=Slider(26, range=0..60),
    CfgScale=Slider(3.5, range=0..30),
    Width=la_aratioimg.Width,
    Height=la_aratioimg.Height,
    NumberImgs=Slider(1, range=1..5),
    SamplerModel=samplers,
    Seed="0",
    ControlNETUnit_0=la_cnunit_loc,
    ControlNETUnit_1=la_cnunit_loc_3,
    ControlNETUnit_2=la_cnunit_loc_2)  # -> Output, InfoSettings
la_seeout = SeeOut(Output=la_ai_mcnt2i_loc.Output, ID=Slider(70, range=0..73))  # -> SeqOut, LastOut
la_opendir = OpenDir(DirectoryPath=la_ai_mcnt2i_loc.Output)  # -> Filename, FolderPath
la_atkimagepreview_4 = ATkImagePreview(Path=la_seeout.SeqOut, Scale=Slider(0.77, range=0..1))
la_atkimagepreview_5 = ATkImagePreview(Path=la_atkimagepreview, Scale=Slider(0.5, range=0..1))
la_atkimagepreview_6 = ATkImagePreview(Path=la_atkimagepreview_3, Scale=Slider(0.6, range=0..1))

la_atk_buymeacoffee = ATkSupportBuyMeACoffee()

# ----
# 2
number_slider = Slider(0, range=0..20)
number_slider_2 = Slider(2, range=0..20)
la_sdchkp_loc = SDchkp_loc(CheckSDmodels=Toggle(False), IDSDModels=0, SetMods=Toggle(False))
la_sdvae_loc = SDVae_loc(CheckSDVae=Toggle(False), IDSDVae=0, SetVAE=Toggle(False))
sd_checkpoint_models_list = Panel(la_sdchkp_loc)
sd_vae_models_list = Panel(la_sdvae_loc)

la_sd_imginfo = SDImginfo(ImgPath=la_atkimagepreview_4)
image_info = Panel(la_sd_imginfo)

# ----
# 1
# set listen only
# if you want to work on your LAN
# from server PC
# left full path clear
# to use default settings
cmdargs = CMDArguments({"API": 1, "lowvram": 2, "xformers": 3, "autolaunch": 4, "theme dark": 5, "share": 6, "listen": 7, "reinstall xformers": 8, "reinstall torch": 9, "skip vers check": 10, "precision full": 11, "no half": 12, "no half vae": 13, "disable NaN check": 14, "upcast sampling": 15, "custom checkpoints": 16, "custom lora": 17, "custom vae": 18, "custom embeddings": 19, "custom hypernetworks": 20}, selected=["API", "lowvram", "xformers", "precision full", "no half", "custom checkpoints", "custom vae"])
path_6 = FilePath("D:\Desktop\ComfyUI\ComfyUI_windows_portable\ComfyUI\models\checkpoints\")
la_modelpaths = ModelPaths(CheckpointsDir=path_6, VAEDir=path, ClearPaths=False)  # -> Status, CommandModelArgs
checkip = Button()
close = Button()
check = Button()
gen = Button()
start = Button()
custom_port = Panel("7869")
path_7 = FilePath("D:\Desktop\SDlocalCNv11\stable-diffusion-webui\")
path_8 = FilePath("D:\Desktop\SDlocalCNv10\stable-diffusion-webui\")
panel_6 = Panel(la_modelpaths.Status)

la_launchsdv2_loc = LaunchSD_loc(
    DirectoryPath=path_7,
    CmdArguments=cmdargs,
    IPPort=7860,
    ModelPathArgs=la_modelpaths.CommandModelArgs,
    GenWebui=gen,
    StartProcess=start,
    CloseProcess=close,
    CheckProcess=check,
    CheckIPconfig=checkip,
    Expression0="1",
    Expression1="2",
    Expression10="11",
    Expression11="12",
    Expression12="13",
    Expression13="14",
    Expression14="15",
    Expression15="16",
    Expression16="17",
    Expression17="18",
    Expression18="19",
    Expression19="20",
    Expression2="3",
    Expression3="4",
    Expression4="5",
    Expression5="6",
    Expression6="7",
    Expression7="8",
    Expression8="9",
    Expression9="10",
    Name0="API",
    Name1="lowvram",
    Name10="precision full",
    Name11="no half",
    Name12="no half vae",
    Name13="disable NaN check",
    Name14="upcast sampling",
    Name15="custom checkpoints",
    Name16="custom lora",
    Name17="custom vae",
    Name18="custom embeddings",
    Name19="custom hypernetworks",
    Name2="xformers",
    Name3="autolaunch",
    Name4="theme dark",
    Name5="share",
    Name6="listen",
    Name7="reinstall xformers",
    Name8="reinstall torch",
    Name9="skip vers check")

panel_7 = Panel(la_launchsdv2_loc)
